# Grasshopper definition InfinityExtend.gh (Grasshopper 1.0.8)
# plug-ins: Pufferfish, Wombat

# InfinityExtend
is_production_mode = BooleanToggle(True)
geo_algorithm_name = Panel("InfinityExtend")
toggle_job_make_it_go = BooleanToggle(False)

# ---- group: Internal Parameters
central_band_strap_width_mm = Panel("8.5")
extent_band_strap_width_mm = Panel("5.0")
mid_joint_rise_factor = Panel("1.0")
axial_band_thickness_mm = Panel("1.75")

# ----
factoryautomatorpy = Python3Script(is_production_mode=is_production_mode, geo_algorithm_name=geo_algorithm_name, toggleJob=toggle_job_make_it_go)  # -> out, interPhalanxDistanceMM, rootCircumferenceMM, midCircumferenceMM, tipCircumferenceMM, flexionDegrees, root_filename, output_dir, objectID, raw_data; inputs is_production_mode: Boolean, toggleJob: Boolean
# ---------- factoryautomatorpy: Python ----------
from pathlib import Path
import sys
from importlib import reload #FOR DEV
import time

ghFileDir = str(Path.joinpath(Path(ghenv.Component.OnPingDocument().FilePath).resolve().parents[0], "src"))
print(f"{ghFileDir=}")

if ghFileDir not in sys.path:
    print("ghFileDir needed to be included")
    sys.path.append(ghFileDir)

import splintcommon
reload(splintcommon) #FOR DEV

splintcommon.log(f'FactoryAutomatorPY Running at: ({time.strftime("%H:%M:%S", time.localtime())})')
# ==================== Component Code ===========================

job_data, objectID, root_filename, output_dir, raw_data = splintcommon.load_job_data(is_production_mode, geo_algorithm_name)

# This mapping must match the schema of the data in the DB for this geometry type
interPhalanxDistanceMM = job_data["interPhalanxDistanceMM"]
rootCircumferenceMM = job_data["rootCircumferenceMM"]
midCircumferenceMM = job_data["midCircumferenceMM"]
tipCircumferenceMM = job_data["tipCircumferenceMM"]
flexionDegrees = job_data["flexionDegrees"]
objectID = job_data["objectID"]

splintcommon.log(f"Result data {geo_algorithm_name=} {objectID=} {interPhalanxDistanceMM=} {rootCircumferenceMM=} {midCircumferenceMM=} {tipCircumferenceMM=} {flexionDegrees=}")
# ---------- end factoryautomatorpy ----------
panel = Panel(factoryautomatorpy.raw_data)
panel_2 = Panel(factoryautomatorpy.out)

# ----
# Finger Preform Solid
# Notes: The infinity_flex is not specific to one joint, but we will model it surrounding the pip joint
# inter_phalanx_distance spans half of the proximal phalanx and half of the middle phalanx and so we will use half of it for the model's proximal_len and middle_len
mid_circ = Number(factoryautomatorpy.midCircumferenceMM)
root_circ = Number(factoryautomatorpy.rootCircumferenceMM)
inter_phalanx_distance = Number(factoryautomatorpy.interPhalanxDistanceMM)
production_mode = Panel(is_production_mode)
awial_band_thickness_mm = Number(axial_band_thickness_mm)
tip_circ = Number(factoryautomatorpy.tipCircumferenceMM)
flexion_degrees = Number(factoryautomatorpy.flexionDegrees)
extent_band_width = Number(extent_band_strap_width_mm)
fingermodel_demo_py = Python3Script(
    toggle=Toggle(False),
    shell_thickness=awial_band_thickness_mm,
    root_circ=root_circ,
    mid_circ=mid_circ,
    tip_circ=tip_circ,
    flexion_degrees=flexion_degrees,
    inter_phalanx_distance=inter_phalanx_distance,
    extent_band_width=extent_band_width)  # -> out, cFinger_brep, cCenterline, cComponents, sCenterline, sFinger_brep, sComponents, splintBlank, splintBlankCenterline
# ---------- fingermodel_demo_py: Python ----------
# This file represents a stub for a GhPython component in Grasshopper.
# It sets up the environment to import and use the splintcommon or other external modules.

from pathlib import Path
import sys
from importlib import reload #FOR DEV ONLY
import time

# In normal GH doc
ghFileDir = None
try:
    ghFileDir = str(Path.joinpath(Path(ghenv.Component.OnPingDocument().FilePath).resolve().parents[0], "src"))
except:
    # In GH Cluster
    ghFileDir = str(Path.joinpath(Path(ghenv.Component.OnPingDocument().Owner.OnPingDocument().FilePath).resolve().parents[0], "src"))

print(f"{ghFileDir=}")

if ghFileDir not in sys.path:
    print("ghFileDir needed to be included")
    sys.path.append(ghFileDir)

import splintcommon
reload(splintcommon) #FOR DEV ONLY

#splintcommon module is now available for use in this GhPython component
splintcommon.log(f'GhPython Node initialized at {time.ctime()}')


from importlib import reload
import FingerModel
reload(FingerModel)

from FingerModel import create_finger_model, FingerParams
from dataclasses import replace

import BrepDifference
reload(BrepDifference) #FOR DEV ONLY
from BrepDifference import robust_brep_difference

# Refresher, order of elements:
# metacarpel numb, mcp, proximal, pip, middle, dip, distal

# input values to work with:
# shell_thickness
# root_circ ~= mcp_circ 
# mid_circ ~=
# tip_circ
# flexion_degrees
# inter_phalanx_distance
# extent_band_width

# The model input values that we need to provide or compute:

trimDistAroundPIP = (inter_phalanx_distance/2) + (extent_band_width/2)

coreParams = FingerParams(
    # Segment range - generate full finger or subset
    start_at="proximal",
    end_at="middle",

    # Joint circumferences (mm)
    mcp_circ=root_circ,
    proximal_mid_circ=root_circ,
    pip_circ=mid_circ,
    middle_mid_circ=tip_circ,
    dip_circ=tip_circ,
    # distal_mid_circ=60.0,
    # tip_circ=45.0,

    # Metacarpal stub length
    metacarpal_len=20.0,

    # Phalanx lengths (mm)
    proximal_len=inter_phalanx_distance,
    middle_len=inter_phalanx_distance,
    # distal_len=None,
    
    # Joint angles (degrees) - positive = curl toward palm
    # mcp_flex=0.0,
    pip_flex=flexion_degrees,
    # dip_flex=0.0,

    # mcp_lateral=0.0,
    # pip_lateral=0.0,
    # dip_lateral=0.0,   
)

# Create the finger model
cCenterline, cFinger_brep, cComponents, cJointPositions = create_finger_model(
    coreParams,
    tolerance=None,      # Use document tolerance
    return_parts=True    # Return individual components
)

# Create the shell params
shellParams = replace(coreParams, shell_thickness=2.0, start_at="proximal", end_at="middle")
shellParams.trim_start=("pip", -1 * trimDistAroundPIP)  # 10mm before MCP joint
shellParams.trim_end=("pip", trimDistAroundPIP)

# Create the shell model
sCenterline, sFinger_brep, sComponents, sJointPositions = create_finger_model(
    shellParams,
    tolerance=None,      # Use document tolerance
    return_parts=True    # Return individual components
)

# Subtract inner from shell to create hollow splint
splintBlank, success, method = robust_brep_difference(
    minuend=sFinger_brep,      # subtract FROM this (larger)
    subtrahend=cFinger_brep,   # subtract this (smaller)
    base_tolerance=0.001
)

splintBlankCenterline = sCenterline

if success:
    print(f"Hollow splint created via {method}")
    # result_brep is now a hollow shell
else:
    print(f"Difference failed: {method}")
# ---------- end fingermodel_demo_py ----------
inner_shell_brep = Brep(fingermodel_demo_py.cFinger_brep)
outer_shell_brep = Brep(fingermodel_demo_py.sFinger_brep)
material_shell_brep = Brep(fingermodel_demo_py.splintBlank)
splint_centerline = Curve(fingermodel_demo_py.splintBlankCenterline)

# ----
# Central Finger Line Geometry
splint_centerline_2 = Curve(splint_centerline)
explode = Explode(Curve=splint_centerline_2, Recursive=True)  # -> Segments, Vertices
list_item = ListItem(List=explode.Segments, Index="0", Wrap=False)
list_item_2 = ListItem(List=explode.Segments, Index="1", Wrap=False)
unit_vector = UnitVector(Vector=list_item)
end_points = EndPoints(Curve=list_item_2)  # -> Start, End
end_points_2 = EndPoints(Curve=list_item)  # -> Start, End
firstsegmentdirection = Vector(unit_vector)
secondsegmentline = Line(list_item_2)
secondsegmentend = Point(end_points.End)
firstsegmentstart = Point(end_points_2.Start)
firstsegmentline = Line(list_item)
firstsegmentend = Point(end_points_2.End)

wall_thickness = Number(axial_band_thickness_mm)
objectid = Text(factoryautomatorpy.objectID)
root_filename_out = Text(factoryautomatorpy.root_filename)
output_dir_out = Text(factoryautomatorpy.output_dir)
panel_3 = Panel(fingermodel_demo_py.out)

# ----
# Alignment Work
secondsegmentend_2 = Point(secondsegmentend)
firstsegmentstart_2 = Point(firstsegmentstart)
line = Line(StartPoint=firstsegmentstart_2, EndPoint=secondsegmentend_2)
average_center_line = Line(line)

brepinspect_py = Python3Script()  # -> out; inputs brepToTest: Brep
# ---------- brepinspect_py: Python ----------
# This file represents a stub for a GhPython component in Grasshopper.
# It sets up the environment to import and use the splintcommon or other external modules.

from pathlib import Path
import sys
from importlib import reload #FOR DEV ONLY
import time

# In normal GH doc
ghFileDir = None
try:
    ghFileDir = str(Path.joinpath(Path(ghenv.Component.OnPingDocument().FilePath).resolve().parents[0], "src"))
except:
    # In GH Cluster
    ghFileDir = str(Path.joinpath(Path(ghenv.Component.OnPingDocument().Owner.OnPingDocument().FilePath).resolve().parents[0], "src"))

print(f"{ghFileDir=}")

if ghFileDir not in sys.path:
    print("ghFileDir needed to be included")
    sys.path.append(ghFileDir)

import splintcommon
reload(splintcommon) #FOR DEV ONLY

#splintcommon module is now available for use in this GhPython component
splintcommon.log(f'GhPython Node initialized at {time.ctime()}')

import BrepInspect
reload(BrepInspect)

BrepInspect.inspect_solid_brep(brepToTest)
# ---------- end brepinspect_py ----------
reliable_union_cl = ReliableUnionCL()  # -> unionresult, unionreport; disabled

# ----
# Preform
# Orientation
# Adjustment
firstsegmentdirection_2 = Vector(firstsegmentdirection)
secondsegmentline_2 = Line(secondsegmentline)
firstsegmentstart_3 = Point(firstsegmentstart)
firstsegmentend_2 = Point(firstsegmentend)
firstsegmentline_2 = Line(firstsegmentline)
average_center_line_2 = Line(average_center_line)
secondsegmentend_3 = Point(secondsegmentend)
material_shell_brep_2 = Brep(material_shell_brep)
inner_shell_brep_2 = Brep(inner_shell_brep)
outer_shell_brep_2 = Brep(outer_shell_brep)
xz_plane = XZPlane(Origin=Point(0, 0, 0))
angle = Angle(VectorA=average_center_line_2, VectorB=firstsegmentdirection_2, Plane=xz_plane)  # -> Angle, Reflex
finger_model_rotate = Rotate(Geometry=material_shell_brep_2, Angle=angle.Angle, Plane=xz_plane)  # -> Geometry, Transform
outer_barrel_transform = Transform(Geometry=outer_shell_brep_2, Transform=finger_model_rotate.Transform)
inner_barrel_transform = Transform(Geometry=inner_shell_brep_2, Transform=finger_model_rotate.Transform)
center_line_transform = Transform(Geometry=average_center_line_2, Transform=finger_model_rotate.Transform)
root_line_transform = Transform(Geometry=firstsegmentline_2, Transform=finger_model_rotate.Transform)
tip_line_transform = Transform(Geometry=secondsegmentline_2, Transform=finger_model_rotate.Transform)
first_orientation_shift_transform = Transform(finger_model_rotate.Transform)
firstsegmentline_3 = Line(root_line_transform)
secondsegmentline_3 = Line(tip_line_transform)
inner_shell_brep_3 = Brep(inner_barrel_transform)

panel_4 = Panel(brepinspect_py)
outer_shell_brep_3 = Brep(outer_barrel_transform)

# ----
# Top Center Band Creation
ref_nudge = Panel("75")
bottom_band_width_mm = Panel(central_band_strap_width_mm)
curve_middle = CurveMiddle(Curve=center_line_transform)
outer_shell_brep_4 = Brep(outer_shell_brep_3)
unit_z = UnitZ(Factor=ref_nudge)
unit_y = UnitY(Factor=ref_nudge)
move_well_below = Move(Geometry=curve_middle, Motion=unit_z)  # -> Geometry, Transform
low_ref_point = Point(move_well_below.Geometry)
move = Move(Geometry=low_ref_point, Motion=unit_y)  # -> Geometry, Transform
point = Point(move.Geometry)
merge = Merge(Data1=curve_middle, Data2=low_ref_point, Data3=point)  # -> flatten(Result)
plane_fit = PlaneFit(Points=merge)  # -> Plane, Deviation
unit_x = UnitX(Factor=1)
xy_plane = XYPlane(Origin=Point(0, 0, 0))
line_sdl = LineSDL(Start=xy_plane, Direction=unit_x, Length=bottom_band_width_mm)
brep_plane = BrepPlane(Brep=outer_shell_brep_4, Plane=plane_fit.Plane)  # -> Curves, Points
curve_closest_point = CurveClosestPoint(Point=low_ref_point, Curve=brep_plane.Curves)  # -> Point, Parameter, Distance
curve_middle_2 = CurveMiddle(Curve=line_sdl)
line_2 = Line(StartPoint=curve_middle_2, EndPoint=curve_closest_point.Point)
move_2 = Move(Geometry=line_sdl, Motion=line_2)  # -> Geometry, Transform
center_band_line = Curve(move_2.Geometry)
outer_shell_brep_5 = Brep(outer_shell_brep_4)
perp_frame = PerpFrame(Curve=center_band_line, Parameter="0")
end_points_3 = EndPoints(Curve=center_band_line)  # -> Start, End
brep_plane_2 = BrepPlane(Brep=outer_shell_brep_5, Plane=perp_frame)  # -> Curves, Points
curve_closest_point_2 = CurveClosestPoint(Point=end_points_3.Start, Curve=brep_plane_2.Curves)  # -> Point, Parameter, Distance
multiplication = Multiplication(A=curve_closest_point_2.Distance, B="1.5")
unit_z_2 = UnitZ(Factor=multiplication)
move_3 = Move(Geometry=center_band_line, Motion=unit_z_2)  # -> Geometry, Transform
central_top_band = Curve(move_3.Geometry)

# ----
# Outer Bottom Bands Creation
outer_shell_brep_6 = Brep(outer_shell_brep_3)
outer_band_width_mm = Panel(extent_band_strap_width_mm)
unit_y_2 = UnitY(Factor=1)
box_center_slice_py = Python3Script(target_brep=outer_shell_brep_6, view_vector=unit_y_2)  # -> out, slice_surface; inputs target_brep: Brep, view_vector: Vector3d
# ---------- box_center_slice_py: Python ----------
# This file represents a stub for a GhPython component in Grasshopper.
# It sets up the environment to import and use the splintcommon or other external modules.

from pathlib import Path
import sys
from importlib import reload #FOR DEV
import time

# In normal GH doc
ghFileDir = None
try:
    ghFileDir = str(Path.joinpath(Path(ghenv.Component.OnPingDocument().FilePath).resolve().parents[0], "src"))
except:
    # In GH Cluster
    ghFileDir = str(Path.joinpath(Path(ghenv.Component.OnPingDocument().Owner.OnPingDocument().FilePath).resolve().parents[0], "src"))

print(f"{ghFileDir=}")

if ghFileDir not in sys.path:
    print("ghFileDir needed to be included")
    sys.path.append(ghFileDir)

import splintcommon
reload(splintcommon) #FOR DEV

#splintcommon module is now available for use in this GhPython component
splintcommon.log(f'GhPython Node initialized at {time.ctime()}')

import FeatureIdentification
reload(FeatureIdentification) #FOR DEV
from FeatureIdentification import box_center_slice

import Rhino.Geometry as rg

# Get a slice plane at the center, facing +Y direction
slice_surface = box_center_slice(
    target_brep=target_brep,
    bbox_plane=rg.Plane.WorldXY,
    choose_side_vector=view_vector
)
# ---------- end box_center_slice_py ----------
box_center_slice_py_2 = Python3Script(target_brep=outer_shell_brep_6, slice_surface=box_center_slice_py.slice_surface)  # -> out, result_curves, result_points; inputs target_brep: Brep, slice_surface: Surface
# ---------- box_center_slice_py_2: Python ----------
# This file represents a stub for a GhPython component in Grasshopper.
# It sets up the environment to import and use the splintcommon or other external modules.

from pathlib import Path
import sys
from importlib import reload #FOR DEV
import time

# In normal GH doc
ghFileDir = None
try:
    ghFileDir = str(Path.joinpath(Path(ghenv.Component.OnPingDocument().FilePath).resolve().parents[0], "src"))
except:
    # In GH Cluster
    ghFileDir = str(Path.joinpath(Path(ghenv.Component.OnPingDocument().Owner.OnPingDocument().FilePath).resolve().parents[0], "src"))

print(f"{ghFileDir=}")

if ghFileDir not in sys.path:
    print("ghFileDir needed to be included")
    sys.path.append(ghFileDir)

import splintcommon
reload(splintcommon) #FOR DEV

#splintcommon module is now available for use in this GhPython component
splintcommon.log(f'GhPython Node initialized at {time.ctime()}')

import FeatureIdentification
reload(FeatureIdentification) #FOR DEV
from FeatureIdentification import intersect_with_reference

import Rhino.Geometry as rg

result_curves, result_points = intersect_with_reference(
    target_brep = target_brep, 
    slice_surface = slice_surface, 
    view_direction = rg.Vector3d.YAxis, 
    up_vector=rg.Vector3d.ZAxis
)
# ---------- end box_center_slice_py_2 ----------
list_item_3 = ListItem(List=box_center_slice_py_2.result_points, Index="2", Wrap=False)
list_item_4 = ListItem(List=box_center_slice_py_2.result_points, Index="3", Wrap=False)
unit_x_2 = UnitX(Factor=1)
unit_x_3 = UnitX(Factor="-1")
nudge = Panel("-2")
unit_z_3 = UnitZ(Factor=nudge)
left_band_guide = LineSDL(Start=list_item_4, Direction=unit_x_2, Length=outer_band_width_mm)
right_band_guide = LineSDL(Start=list_item_3, Direction=unit_x_3, Length=outer_band_width_mm)
move_4 = Move(Geometry=right_band_guide, Motion=unit_z_3)  # -> Geometry, Transform
move_5 = Move(Geometry=left_band_guide, Motion=unit_z_3)  # -> Geometry, Transform
tip_outer_band = Curve(move_4.Geometry)
root_outer_band = Curve(move_5.Geometry)

# ----
# Side Cutter Profile
bottom_band_width_mm_2 = Panel(central_band_strap_width_mm)
mid_joint_rise_factor_2 = Panel(mid_joint_rise_factor)
root_top_band = Curve(root_outer_band)
tip_top_band = Curve(tip_outer_band)
bottom_band = Curve(central_top_band)
multiplication_2 = Multiplication(A=bottom_band_width_mm_2, B=mid_joint_rise_factor_2)
midpoint = Midpoint(Curve=bottom_band)
negative = Negative(Value=multiplication_2)
unit_z_4 = UnitZ(Factor=negative)
move_6 = Move(Geometry=midpoint, Motion=unit_z_4)  # -> Geometry, Transform
end_points_4 = EndPoints(Curve=bottom_band)  # -> Start, End
end_points_5 = EndPoints(Curve=root_top_band)  # -> Start, End
end_points_6 = EndPoints(Curve=tip_top_band)  # -> Start, End
top_right_band_right_pt = Point(end_points_6.Start)
bottom_right_pt = Point(end_points_4.End)
bottom_left_pt = Point(end_points_4.Start)
top_left_band_left_pt = Point(end_points_5.Start)
top_left_band_right_pt = Point(end_points_5.End)
central_pt = Point(move_6.Geometry)
top_right_band_left_pt = Point(end_points_6.End)
line_3 = Line(StartPoint=top_left_band_right_pt, EndPoint=central_pt)
line_4 = Line(StartPoint=central_pt, EndPoint=top_right_band_left_pt)
midpoint_2 = Midpoint(Curve=line_3)
midpoint_3 = Midpoint(Curve=line_4)
line_5 = Line(StartPoint=bottom_right_pt, EndPoint=bottom_left_pt)
line_6 = Line(StartPoint=bottom_left_pt, EndPoint=top_left_band_left_pt)
line_7 = Line(StartPoint=top_left_band_left_pt, EndPoint=top_left_band_right_pt)
tip_slant_line = Line(StartPoint=top_right_band_right_pt, EndPoint=bottom_right_pt)
line_8 = Line(StartPoint=top_left_band_right_pt, EndPoint=midpoint_2)
line_9 = Line(StartPoint=top_right_band_left_pt, EndPoint=top_right_band_right_pt)
line_10 = Line(StartPoint=midpoint_3, EndPoint=top_right_band_left_pt)
merge_2 = Merge(Data1=line_5, Data2=line_6, Data3=line_7, Data4=line_8, Data6=line_10, Data7=line_9, Data8=tip_slant_line)  # -> flatten(Result)
join_curves = JoinCurves(Curves=merge_2, Preserve=False)
connect_curves = ConnectCurves(Curves=join_curves, Continuity=2, Close=True, Bulge=Slider(0.6, range=0..2))
close_curve = CloseCurve(Curve=connect_curves, Tolerance=0)
xz_plane_2 = XZPlane(Origin=Point(0, 0, 0))
unit_y_3 = UnitY(Factor="-30")
project = Project(Geometry=close_curve, Plane=xz_plane_2)  # -> Geometry, Transform
planar = Planar(Curve=project.Geometry)  # -> Planar, Plane, Deviation
move_7 = Move(Geometry=project.Geometry, Motion=unit_y_3)  # -> Geometry, Transform
panel_5 = Panel(planar.Planar)
cutter_curve = Curve(move_7.Geometry)

# ----
# Side Cutter Volume
cutter_curve_2 = Curve(cutter_curve)
panel_6 = Panel(cutter_curve_2)
unit_y_4 = UnitY(Factor="60")
boundary_surfaces = BoundarySurfaces(Edges=cutter_curve_2)
extrude = Extrude(Base=boundary_surfaces, Direction=unit_y_4)
side_cutter_surface = Surface(boundary_surfaces)
side_cutter_volume = Brep(extrude)

# ----
# Splint Body
preform_tube_brep = Brep(finger_model_rotate.Geometry)
solid_intersection = SolidIntersection(BrepsA=preform_tube_brep, BrepsB=side_cutter_volume)
splint_body = Brep(solid_intersection)

# ----
# ID Embossing Gun
finishedsplintbrep = Brep(splint_body)
wall_thickness_mm = Number(wall_thickness)
objectid_text = Text(reverse(objectid))
side_projection_angle = Slider(21, range=-90..90)
unit_z_5 = UnitZ(Factor=1)
unit_y_5 = UnitY(Factor=1)
yz_plane = YZPlane(Origin=Point(0, 0, 0))
text_size = Slider(3.5, range=2.5..6)
bounding_box = BoundingBox(Content=finishedsplintbrep, Plane=PlaneXY(0, 0, 0))  # -> Box, Box_2
rotate = Rotate(Geometry=unit_y_5, Angle=degrees(side_projection_angle), Plane=yz_plane)  # -> Geometry, Transform
transform = Transform(Geometry=unit_z_5, Transform=rotate.Transform)
volume = Volume(Geometry=bounding_box.Box)  # -> Volume, Centroid
line_sdl_2 = LineSDL(Start=volume.Centroid, Direction=rotate.Geometry, Length=Slider(4, range=0..10))
textgun_py = Python3Script(
    splint_brep=finishedsplintbrep,
    object_id=objectid_text,
    text_up_vector=transform,
    wall_thickness_mm=wall_thickness_mm,
    text_size=text_size,
    text_projection_vector=rotate.Geometry,
    extrusion_depth_factor="0.5")  # -> out, embossedBrep, originalTextBreps, final_text_plane, projected_letters; inputs splint_brep: Brep, object_id: String, text_up_vector: Vector3d, text_size: Double, text_projection_vector: Vector3d, extrusion_depth_factor: Double
# ---------- textgun_py: Python ----------
# This file represents a stub for a GhPython component in Grasshopper.
# It sets up the environment to import and use the splintcommon or other external modules.

from pathlib import Path
import sys
from importlib import reload #FOR DEV ONLY
import time

# In normal GH doc
ghFileDir = None
try:
    ghFileDir = str(Path.joinpath(Path(ghenv.Component.OnPingDocument().FilePath).resolve().parents[0], "src"))
except:
    # In GH Cluster
    ghFileDir = str(Path.joinpath(Path(ghenv.Component.OnPingDocument().Owner.OnPingDocument().FilePath).resolve().parents[0], "src"))

print(f"{ghFileDir=}")

if ghFileDir not in sys.path:
    print("ghFileDir needed to be included")
    sys.path.append(ghFileDir)

import splintcommon
reload(splintcommon) #FOR DEV

#splintcommon module is now available for use in this GhPython component
splintcommon.log(f'GhPython Node initialized at {time.ctime()}')

import TextGun
reload(TextGun) #FOR DEV
from TextGun import emboss_text

embossedBrep, originalTextBreps, projected_letters, final_text_plane = emboss_text(
    target_brep=splint_brep,
    text_content=object_id,
    wall_thickness_mm=wall_thickness_mm,
    text_size=text_size,
    text_up_vector=text_up_vector,
    text_projection_vector=text_projection_vector,
    extrusion_depth_factor=extrusion_depth_factor,
    emboss_inside=True
)
# ---------- end textgun_py ----------
panel_7 = Panel(textgun_py.out)
vizvector = VizVector(start=volume.Centroid, direction=transform, arrowlen="4", text="up")  # -> cone_2, line, annotation_dot_2
vizvector_2 = VizVector(start=volume.Centroid, direction=rotate.Geometry, arrowlen="4", text="proj")  # -> cone_2, line, annotation_dot_2
tip = Brep(vizvector.cone_2)
line_11 = Line(vizvector.line)
annotation_dot = AnnotationDot(vizvector.annotation_dot_2)
splint_with_embossed_id = Brep(textgun_py.embossedBrep)
plane = Plane(textgun_py.final_text_plane)
plane_2 = Plane(plane)
vizplane = VizPlane(plane=plane_2)  # -> tip_2, line_2, annotation_dot_2
tip_2 = Brep(vizplane.tip_2)
line_12 = Line(vizplane.line_2)
annotation_dot_2 = AnnotationDot(vizplane.annotation_dot_2)
brep = Brep(textgun_py.originalTextBreps)

# ----
# Comfort Top Lip Trimmers
unit_y_6 = UnitY(Factor=1)
mid_circumference = Number(mid_circ)
circ2rad = Python3Script(circumference=mid_circumference)  # -> radius
# ---------- circ2rad: Python ----------
from math import pi

radius = circumference / (2 * pi)

print(f"{circumference=} {radius=}")
# ---------- end circ2rad ----------
chamfer_side_limit_angle = Slider(-74, range=-90..90)
chamfer_edge_parameter = Slider(0.7, range=0..1)
splint_brep = Brep(splint_with_embossed_id)
box_center_slice_py_3 = Python3Script(target_brep=splint_brep, view_vector=unit_y_6)  # -> out, slice_surface; inputs target_brep: Brep, view_vector: Vector3d; same code as box_center_slice_py
multiplication_3 = Multiplication(A=circ2rad, B=Slider(1.29, range=0.75..2))
area = Area(Geometry=box_center_slice_py_3.slice_surface)  # -> Area, Centroid
xy_plane_2 = XYPlane(Origin=area.Centroid)
unit_z_6 = UnitZ(Factor=multiplication_3)
scale_nu = ScaleNU(Geometry=box_center_slice_py_3.slice_surface, Plane=xy_plane_2, ScaleX=Slider(1, range=0.1..1.1), ScaleY=1, ScaleZ=1)  # -> Geometry, Transform
move_8 = Move(Geometry=scale_nu.Geometry, Motion=unit_z_6)  # -> Geometry, Transform
box_center_slice_py_4 = Python3Script(target_brep=splint_brep, slice_surface=move_8.Geometry)  # -> out, result_curves, result_points; inputs target_brep: Brep, slice_surface: Surface; same code as box_center_slice_py_2
splint_center_point = Point(area.Centroid)
chamfer_side_limit_angle_2 = Number(chamfer_side_limit_angle)
splint_with_embossed_id_2 = Brep(splint_brep)
point_2 = Point(box_center_slice_py_4.result_points)
mid_radius = Number(multiplication_3)
curve = Curve(box_center_slice_py_4.result_curves)
yz_plane_2 = YZPlane(Origin=Point(0, 0, 0))
xy_plane_3 = XYPlane(Origin=Point(0, 0, 0))
unit_y_7 = UnitY(Factor=1)
mid_radius_2 = Number(mid_radius)
negative_2 = Negative(Value=chamfer_side_limit_angle_2)
rotate_2 = Rotate(Geometry=unit_y_7, Angle=degrees(negative_2), Plane=yz_plane_2)  # -> Geometry, Transform
transform_2 = Transform(Geometry=xy_plane_3, Transform=rotate_2.Transform)
rotate_3 = Rotate(Geometry=unit_y_7, Angle=degrees(chamfer_side_limit_angle_2), Plane=yz_plane_2)  # -> Geometry, Transform
transform_3 = Transform(Geometry=xy_plane_3, Transform=rotate_3.Transform)
box_center_slice_py_5 = Python3Script(target_brep=splint_with_embossed_id_2, bbox_plane=transform_3, view_vector=rotate_3.Geometry)  # -> out, slice_surface; inputs target_brep: Brep, bbox_plane: Plane, view_vector: Vector3d
# ---------- box_center_slice_py_5: Python ----------
# This file represents a stub for a GhPython component in Grasshopper.
# It sets up the environment to import and use the splintcommon or other external modules.

from pathlib import Path
import sys
from importlib import reload #FOR DEV
import time

# In normal GH doc
ghFileDir = None
try:
    ghFileDir = str(Path.joinpath(Path(ghenv.Component.OnPingDocument().FilePath).resolve().parents[0], "src"))
except:
    # In GH Cluster
    ghFileDir = str(Path.joinpath(Path(ghenv.Component.OnPingDocument().Owner.OnPingDocument().FilePath).resolve().parents[0], "src"))

print(f"{ghFileDir=}")

if ghFileDir not in sys.path:
    print("ghFileDir needed to be included")
    sys.path.append(ghFileDir)

import splintcommon
reload(splintcommon) #FOR DEV

#splintcommon module is now available for use in this GhPython component
splintcommon.log(f'GhPython Node initialized at {time.ctime()}')

import FeatureIdentification
reload(FeatureIdentification) #FOR DEV
from FeatureIdentification import box_center_slice

import Rhino.Geometry as rg

# Get a slice plane at the center, facing +Y direction
slice_surface = box_center_slice(
    target_brep=target_brep,
    bbox_plane=bbox_plane,
    choose_side_vector=view_vector
)
# ---------- end box_center_slice_py_5 ----------
deconstruct_plane = DeconstructPlane(Plane=transform_2)  # -> Origin, XAxis, YAxis, ZAxis
box_center_slice_py_6 = Python3Script(target_brep=splint_with_embossed_id_2, bbox_plane=transform_2, view_vector=rotate_2.Geometry)  # -> out, slice_surface; inputs target_brep: Brep, bbox_plane: Plane, view_vector: Vector3d; same code as box_center_slice_py_5
deconstruct_plane_2 = DeconstructPlane(Plane=transform_3)  # -> Origin, XAxis, YAxis, ZAxis
tl_point = ListItem(List=point_2, Index="0", Wrap=True)
bl_point = ListItem(List=point_2, Index="3", Wrap=True)
tr_point = ListItem(List=point_2, Index="1", Wrap=True)
br_point = ListItem(List=point_2, Index="2", Wrap=True)
multiplication_4 = Multiplication(A=deconstruct_plane.ZAxis, B=mid_radius_2)
chamfer_edge_parameter_2 = Number(chamfer_edge_parameter)
line_13 = Line(StartPoint=tl_point, EndPoint=bl_point)
line_14 = Line(StartPoint=tr_point, EndPoint=br_point)
multiplication_5 = Multiplication(A=deconstruct_plane_2.ZAxis, B=mid_radius)
move_9 = Move(Geometry=box_center_slice_py_6.slice_surface, Motion=multiplication_4)  # -> Geometry, Transform
move_10 = Move(Geometry=box_center_slice_py_5.slice_surface, Motion=multiplication_5)  # -> Geometry, Transform
reparameterize_curve = ReparameterizeCurve(Curve=line_14)  # -> Reparameterized, Original
reparameterize_curve_2 = ReparameterizeCurve(Curve=line_13)  # -> Reparameterized, Original
splint_center_point_2 = Point(splint_center_point)
box_center_slice_py_7 = Python3Script(target_brep=splint_with_embossed_id_2, slice_surface=move_9.Geometry)  # -> out, result_curves, result_points; inputs target_brep: Brep, slice_surface: Surface; same code as box_center_slice_py_2
box_center_slice_py_8 = Python3Script(target_brep=splint_with_embossed_id_2, slice_surface=move_10.Geometry)  # -> out, result_curves, result_points; inputs target_brep: Brep, slice_surface: Surface; same code as box_center_slice_py_2
evaluate_curve = EvaluateCurve(Curve=reparameterize_curve.Reparameterized, Parameter=chamfer_edge_parameter_2)  # -> Point, Tangent, Angle
evaluate_curve_2 = EvaluateCurve(Curve=reparameterize_curve_2.Reparameterized, Parameter=chamfer_edge_parameter_2)  # -> Point, Tangent, Angle
curve_2 = Curve(box_center_slice_py_8.result_curves)
righ_top_mid_lip = Point(evaluate_curve.Point)
left_top_mid_lip = Point(evaluate_curve_2.Point)
point_3 = Point(box_center_slice_py_8.result_points)
curve_3 = Curve(box_center_slice_py_7.result_curves)
point_4 = Point(box_center_slice_py_7.result_points)
left_bottom_mid_lip = Point(left_top_mid_lip)
tl_point_2 = ListItem(List=point_3, Index="3", Wrap=True)
righ_bottom_mid_lip = Point(righ_top_mid_lip)
tl_point_3 = ListItem(List=point_4, Index="3", Wrap=True)
tr_point_2 = ListItem(List=point_4, Index="2", Wrap=True)
tr_point_3 = ListItem(List=point_3, Index="2", Wrap=True)
conecreator = ConeCreator(splint_center_point=splint_center_point_2, point_a=tl_point_3, point_b=left_bottom_mid_lip, point_c=tl_point_2)
conecreator_2 = ConeCreator(splint_center_point=splint_center_point_2, point_a=tr_point_3, point_b=righ_bottom_mid_lip, point_c=tr_point_2)
splint_with_embossed_id_3 = Brep(splint_brep)
solid_difference = SolidDifference(BrepsA=splint_with_embossed_id_3, BrepsB=conecreator_2)
solid_difference_2 = SolidDifference(BrepsA=solid_difference, BrepsB=conecreator)
comfort_trimmed_splint_brep = Brep(solid_difference_2)

vizplane_2 = VizPlane(plane=PlaneXY(0, 0, 0))  # -> tip_2, line_2, annotation_dot_2
ext_ln_pts = ExtLnPts()
vizvector_3 = VizVector(direction=Vector(0, 0, 1))  # -> cone_2, line, annotation_dot_2
vizplane_3 = VizPlane(plane=PlaneXY(0, 0, 0))  # -> tip_2, line_2, annotation_dot_2
wall_thickness_2 = Number(wall_thickness)
dev_activate_toggle = BooleanToggle(True)
root_filename_out_2 = Text(root_filename_out)
output_dir_out_2 = Text(output_dir_out)

# ----
# Comfort Bottom Lip Trimmers
unit_y_8 = UnitY(Factor=1)
mid_circumference_2 = Number(mid_circ)
chamfer_side_limit_angle_3 = Slider(-74, range=-90..90)
chamfer_edge_parameter_3 = Slider(0.7, range=0..1)
circ2rad_2 = Python3Script(circumference=mid_circumference_2)  # -> radius; same code as circ2rad
splint_brep_2 = Brep(comfort_trimmed_splint_brep)
box_center_slice_py_9 = Python3Script(target_brep=splint_brep_2, view_vector=unit_y_8)  # -> out, slice_surface; inputs target_brep: Brep, view_vector: Vector3d; same code as box_center_slice_py
area_2 = Area(Geometry=box_center_slice_py_9.slice_surface)  # -> Area, Centroid
xy_plane_4 = XYPlane(Origin=area_2.Centroid)
scale_nu_2 = ScaleNU(Geometry=box_center_slice_py_9.slice_surface, Plane=xy_plane_4, ScaleX=Slider(1, range=0.1..1.1), ScaleY=1, ScaleZ=1)  # -> Geometry, Transform
splint_center_point_3 = Point(area_2.Centroid)
chamfer_side_limit_angle_4 = Number(chamfer_side_limit_angle_3)
splint_with_embossed_id_4 = Brep(splint_brep_2)
yz_plane_3 = YZPlane(Origin=Point(0, 0, 0))
xy_plane_5 = XYPlane(Origin=Point(0, 0, 0))
unit_y_9 = UnitY(Factor=1)
negative_3 = Negative(Value=chamfer_side_limit_angle_4)
rotate_4 = Rotate(Geometry=unit_y_9, Angle=degrees(negative_3), Plane=yz_plane_3)  # -> Geometry, Transform
transform_4 = Transform(Geometry=xy_plane_5, Transform=rotate_4.Transform)
rotate_5 = Rotate(Geometry=unit_y_9, Angle=degrees(chamfer_side_limit_angle_4), Plane=yz_plane_3)  # -> Geometry, Transform
transform_5 = Transform(Geometry=xy_plane_5, Transform=rotate_5.Transform)
box_center_slice_py_10 = Python3Script(target_brep=splint_with_embossed_id_4, bbox_plane=transform_5, view_vector=rotate_5.Geometry)  # -> out, slice_surface; inputs target_brep: Brep, bbox_plane: Plane, view_vector: Vector3d; same code as box_center_slice_py_5
deconstruct_plane_3 = DeconstructPlane(Plane=transform_4)  # -> Origin, XAxis, YAxis, ZAxis
box_center_slice_py_11 = Python3Script(target_brep=splint_with_embossed_id_4, bbox_plane=transform_4, view_vector=rotate_4.Geometry)  # -> out, slice_surface; inputs target_brep: Brep, bbox_plane: Plane, view_vector: Vector3d; same code as box_center_slice_py_5
deconstruct_plane_4 = DeconstructPlane(Plane=transform_5)  # -> Origin, XAxis, YAxis, ZAxis
chamfer_edge_parameter_4 = Number(chamfer_edge_parameter_3)
splint_center_point_4 = Point(splint_center_point_3)
splint_brep_3 = Brep(splint_brep_2)

negative_4 = Negative(Value=circ2rad_2)

multiplication_6 = Multiplication(A=negative_4, B=Slider(1.29, range=0.75..2))
unit_z_7 = UnitZ(Factor=multiplication_6)
move_11 = Move(Geometry=scale_nu_2.Geometry, Motion=unit_z_7)  # -> Geometry, Transform
box_center_slice_py_12 = Python3Script(target_brep=splint_brep_2, slice_surface=move_11.Geometry)  # -> out, result_curves, result_points; inputs target_brep: Brep, slice_surface: Surface; same code as box_center_slice_py_2
mid_radius_3 = Number(multiplication_6)
curve_4 = Curve(box_center_slice_py_12.result_curves)
point_5 = Point(box_center_slice_py_12.result_points)
mid_radius_4 = Number(mid_radius_3)
tl_point_4 = ListItem(List=point_5, Index="0", Wrap=True)
bl_point_2 = ListItem(List=point_5, Index="3", Wrap=True)
tr_point_4 = ListItem(List=point_5, Index="1", Wrap=True)
br_point_2 = ListItem(List=point_5, Index="2", Wrap=True)
multiplication_7 = Multiplication(A=deconstruct_plane_3.ZAxis, B=mid_radius_4)
line_15 = Line(StartPoint=tl_point_4, EndPoint=bl_point_2)
line_16 = Line(StartPoint=tr_point_4, EndPoint=br_point_2)
multiplication_8 = Multiplication(A=deconstruct_plane_4.ZAxis, B=mid_radius_3)
move_12 = Move(Geometry=box_center_slice_py_11.slice_surface, Motion=multiplication_7)  # -> Geometry, Transform
move_13 = Move(Geometry=box_center_slice_py_10.slice_surface, Motion=multiplication_8)  # -> Geometry, Transform
reparameterize_curve_3 = ReparameterizeCurve(Curve=line_16)  # -> Reparameterized, Original
reparameterize_curve_4 = ReparameterizeCurve(Curve=line_15)  # -> Reparameterized, Original
box_center_slice_py_13 = Python3Script(target_brep=splint_with_embossed_id_4, slice_surface=move_12.Geometry)  # -> out, result_curves, result_points; inputs target_brep: Brep, slice_surface: Surface; same code as box_center_slice_py_2
box_center_slice_py_14 = Python3Script(target_brep=splint_with_embossed_id_4, slice_surface=move_13.Geometry)  # -> out, result_curves, result_points; inputs target_brep: Brep, slice_surface: Surface; same code as box_center_slice_py_2
evaluate_curve_3 = EvaluateCurve(Curve=reparameterize_curve_3.Reparameterized, Parameter=chamfer_edge_parameter_4)  # -> Point, Tangent, Angle
evaluate_curve_4 = EvaluateCurve(Curve=reparameterize_curve_4.Reparameterized, Parameter=chamfer_edge_parameter_4)  # -> Point, Tangent, Angle
curve_5 = Curve(box_center_slice_py_14.result_curves)
righ_top_mid_lip_2 = Point(evaluate_curve_3.Point)
left_top_mid_lip_2 = Point(evaluate_curve_4.Point)
point_6 = Point(box_center_slice_py_14.result_points)
curve_6 = Curve(box_center_slice_py_13.result_curves)
point_7 = Point(box_center_slice_py_13.result_points)
tr_point_5 = ListItem(List=point_6, Index="2", Wrap=True)
tr_point_6 = ListItem(List=point_7, Index="2", Wrap=True)
tl_point_5 = ListItem(List=point_7, Index="3", Wrap=True)
left_bottom_mid_lip_2 = Point(left_top_mid_lip_2)
tl_point_6 = ListItem(List=point_6, Index="3", Wrap=True)
righ_bottom_mid_lip_2 = Point(righ_top_mid_lip_2)
conecreator_3 = ConeCreator(splint_center_point=splint_center_point_4, point_a=tl_point_5, point_b=left_bottom_mid_lip_2, point_c=tl_point_6)  # disabled
conecreator_4 = ConeCreator(splint_center_point=splint_center_point_4, point_a=tr_point_5, point_b=righ_bottom_mid_lip_2, point_c=tr_point_6)  # disabled

trim_rectangles = Rectangle(flatten([move_13.Geometry, move_12.Geometry]))
cluster = Cluster(trim_rectangles=trim_rectangles, point_a=tl_point_5, point_b=left_bottom_mid_lip_2, point_c=tl_point_6)
cluster_2 = Cluster_2(trim_rectangles=trim_rectangles, point_a=tr_point_5, point_b=righ_bottom_mid_lip_2, point_c=tr_point_6)

solid_difference_3 = SolidDifference(BrepsA=splint_brep_3, BrepsB=cluster_2)
solid_difference_4 = SolidDifference(BrepsA=solid_difference_3, BrepsB=cluster)
comfort_trimmed_splint_brep_2 = Brep(solid_difference_4)

# ----
# Direction Indicator
splint_body_2 = Brep(comfort_trimmed_splint_brep_2)
wall_thickness_3 = Number(wall_thickness)
unit_y_10 = UnitY(Factor=1)
box_center_slice_py_15 = Python3Script(target_brep=splint_body_2, view_vector=unit_y_10)  # -> out, slice_surface; inputs target_brep: Brep, view_vector: Vector3d; same code as box_center_slice_py
ball_r_to_wall_ratio = Slider(0.68, range=0.6..1)
box_center_slice_py_16 = Python3Script(target_brep=splint_body_2, slice_surface=box_center_slice_py_15.slice_surface)  # -> out, result_curves, result_points; inputs target_brep: Brep, slice_surface: Surface; same code as box_center_slice_py_2
multiplication_9 = Multiplication(A=wall_thickness_3, B=ball_r_to_wall_ratio)
number_slider = Slider(0.5, range=0.1..1.1)
list_item_5 = ListItem(List=box_center_slice_py_16.result_points, Index="2", Wrap=False)
nub_radius = Panel(multiplication_9)
xy_plane_6 = XYPlane(Origin=list_item_5)
xy_plane_7 = XYPlane(Origin=Point(0, 0, 0))
scale_nu_3 = ScaleNU(Geometry=box_center_slice_py_15.slice_surface, Plane=xy_plane_6, ScaleX=number_slider, ScaleY=1, ScaleZ=number_slider)  # -> Geometry, Transform
sphere = Sphere(Base=xy_plane_7, Radius=nub_radius)
move_14 = Move(Geometry=scale_nu_3.Geometry, Motion="5, 0, -5")  # -> Geometry, Transform
box_center_slice_py_17 = Python3Script(target_brep=splint_body_2, slice_surface=move_14.Geometry)  # -> out, result_curves, result_points; inputs target_brep: Brep, slice_surface: Surface; same code as box_center_slice_py_2
ball_r_to_wall_ratio_2 = Slider(0.67, range=0.6..1)
join_curves_2 = JoinCurves(Curves=box_center_slice_py_17.result_curves, Preserve=False)
multiplication_10 = Multiplication(A=wall_thickness_3, B=ball_r_to_wall_ratio_2, C="-1")
area_3 = Area(Geometry=join_curves_2)  # -> Area, Centroid
unit_z_8 = UnitZ(Factor=multiplication_10)
move_15 = Move(Geometry=area_3.Centroid, Motion=unit_z_8)  # -> Geometry, Transform
move_to_point = MoveToPoint(Geometry=sphere, PointA=xy_plane_7, PointB=move_15.Geometry)  # -> Moved, Vector, Transform
solid_difference_5 = SolidDifference(BrepsA=splint_body_2, BrepsB=move_to_point.Moved)
splint_w_direction = Brep(solid_difference_5)

# ----
# Orienting To Build Plate
# Tip Slant Line, describes the angle necessary to bring the front cut line of the splint down to the build platform.
tip_slant_line_2 = Line(tip_slant_line)
finishedsplint = Brep(splint_w_direction)
xz_plane_3 = XZPlane(Origin=Point(0, 0, 0))
flip_curve = FlipCurve(Curve=tip_slant_line_2)  # -> Curve, Flag
unit_x_4 = UnitX(Factor=1)
end_points_7 = EndPoints(Curve=tip_slant_line_2)  # -> Start, End
angle_2 = Angle(VectorA=tip_slant_line_2, VectorB=unit_x_4, Plane=xz_plane_3)  # -> Angle, Reflex
negative_5 = Negative(Value=angle_2.Angle)
point_8 = Point(end_points_7.Start)
point_9 = Point(end_points_7.End)
plane_origin = PlaneOrigin(Base=xz_plane_3, Origin=point_9)
rotate_6 = Rotate(Geometry=finishedsplint, Angle=negative_5, Plane=plane_origin)  # -> Geometry, Transform
orientedsplint = Brep(rotate_6.Geometry)

# ----
# Final Joining
# And Smoothing
# Bake Me
number_slider_2 = Slider(0.12, range=0.05..0.2)
orientedsplint_2 = Brep(orientedsplint)
shrinkwrap = ShrinkWrap(
    Geometry=orientedsplint_2,
    EdgeLength=number_slider_2,
    Offset=0,
    Smoothing=Slider(8, range=0..10),
    Optimization=10,
    FillHoles=True)
final_smooth_splint = Mesh(shrinkwrap)

comfort_trimmed_splint_brep_3 = Brep(comfort_trimmed_splint_brep_2)
savemeshpy = Python3Script(
    geo_input=final_smooth_splint,
    output_file_dir=output_dir_out_2,
    jobname=root_filename_out_2,
    bool_activate=dev_activate_toggle)  # -> out; inputs geo_input: Mesh
# ---------- savemeshpy: Python ----------
# See: https://discourse.mcneel.com/t/how-to-optimise-ghpython-obj-export/87598/76

# This code is intended to be run inside a Grasshopper Python component
# It exports a given mesh to an OBJ or STL file using Rhino's export functionality
# Node inputs:
#   geo_input: The input mesh to be exported (Rhino.Geometry.Mesh)
#   output_file_dir: The directory where the exported file will be saved (string)
#   jobname: The base name for the exported file (string)

# Start standard gh python imports
from pathlib import Path
import sys
from importlib import reload #FOR DEV ONLY

ghFileDir = str(Path.joinpath(Path(ghenv.Component.OnPingDocument().FilePath).resolve().parents[0], "src"))
if ghFileDir not in sys.path:
    print("ghFileDir needed to be included")
    sys.path.append(ghFileDir)
import splintcommon
reload(splintcommon)
# End standard gh python imports

import time
splintcommon.log(f'Save Mesh Running at: ({time.strftime("%H:%M:%S", time.localtime())})')

import scriptcontext as sc
# import rhinoscriptsyntax as rs
import System
import Rhino
import random
import string
import os
import traceback

def add_layer(layer_name=None, layer_color=None):
    """Adds a new layer to the active Rhino document.
    
    Args:
      layer_name (str): An optional layer name.
      layer_color (System.Drawing.Color): An optional layer color.
    Returns:
      The index of the new layer.
    """
    sc.doc = Rhino.RhinoDoc.ActiveDoc
    if layer_name != None:
        # Check whether the layer name is valid
        if not Rhino.DocObjects.Layer.IsValidName(layer_name):
            raise ValueError("{} is not a valid layer name."\
                .format(layer_name))
        # Check whether a layer with the same name already exists
        layer_index = sc.doc.Layers.Find(layer_name, True)
        if layer_index >= 0:
            raise ValueError("A layer with the name {} already exists."\
                .format(layer_name))
    else:
        layer_name = sc.doc.Layers.GetUnusedLayerName(False)
    
    # Check whether the layer color is valid
    if layer_color != None:
        if not isinstance(layer_color, System.Drawing.Color):
            raise ValueError("{} is not a valid layer color."\
                .format(layer_color))
    else:
        layer_color = System.Drawing.Color.Black # default layer color
    
    # Add a new layer to the active document
    layer_index = sc.doc.Layers.Add(layer_name, layer_color)
    if layer_index < 0:
        raise ValueError("Unable to add layer {} to document."\
            .format(layer_name))
    return layer_index
    

def delete_layer(layer):
    """Deletes an existing layer from the active Rhino document. 
    The layer to be removed cannot be the current layer and 
    it will be deleted even if it contains objects.
    
    Args:
      layer (str\id): A name or id of an existing layer.
    Returns:
      True or False, indicating success or failure.
    """
    sc.doc = Rhino.RhinoDoc.ActiveDoc
    layer_index = sc.doc.Layers.Find(layer, True)
    if layer_index < 0:
        raise ValueError("The layer {} does not exist.".format(layer))
    rc = sc.doc.Layers.Purge(layer_index, True)
    sc.doc.Views.Redraw()
    return rc
    

def bake_mesh(layer, mesh, mesh_name=None):
    """Bakes a mesh object to the active Rhino document.
    
    Args:
      layer (str\id): The name or id of an existing layer.
      mesh (Rhino.Geometry.Mesh): A mesh object to bake.
      mesh_name (str): An optional mesh object name.
    Returns:
      The GUID of the baked mesh.
    """

    splintcommon.log(f"mesh type:{type(mesh)}")
    # mesh = rs.coercemesh(mesh)
    # splintcommon.log(f"mesh type:{type(mesh)}")

    sc.doc = Rhino.RhinoDoc.ActiveDoc
    # Check whether the mesh is a mesh object
    if mesh.ObjectType != Rhino.DocObjects.ObjectType.Mesh:
        raise ValueError("{} is not a mesh.".format(mesh))
    # Create the mesh object attributes
    attr = Rhino.DocObjects.ObjectAttributes()
    # Set the mesh object layer index attribute
    layer_index = sc.doc.Layers.Find(layer, True)
    if layer_index < 0:
        if layer == "Default":
            raise ValueError("The layer {} can't be baked to.".format(layer))
        else:
            raise ValueError("The layer {} does not exist.".format(layer))    
    else:
        attr.LayerIndex = layer_index
    # Set the mesh object name attribute
    if mesh_name != None:
        attr.Name = mesh_name
    # Bake the mesh to the active Rhino documemnt
    mesh_id = sc.doc.Objects.AddMesh(mesh, attr)
    return mesh_id

def get_obj_settings():
    splintcommon.log("Using OBJ mesh settings")
    """Returns the settings for the OBJ export command as a string."""
    # Formatting options
    cfg = "_Geometry=_Mesh "
    cfg += "_EndOfLine=CRLF "
    cfg += "_ExportRhinoObjectNames=_ExportObjectsAsOBJGroups "
    cfg += "_ExportMeshTextureCoordinates=_Yes "
    cfg += "_ExportMeshVertexNormals=_Yes "
    cfg += "_ExportMeshVertexColors=_Yes "
    cfg += "_CreateNGons=_No "
    cfg += "_ExportMaterialDefinitions=_No "
    cfg += "_YUp=_Yes "
    cfg += "_WrapLongLines=_No "
    cfg += "_VertexWelding=_Unmodified "
    cfg += "_WritePrecision=4 "
    cfg += "_Enter "
    # Detailed options
    cfg += "_DetailedOptions "
    cfg += "_JaggedSeams=_No "
    cfg += "_PackTextures=_No "
    cfg += "_Refine=_No "
    cfg += "_SimplePlane=_No "
    # Advanced options
    cfg += "_AdvancedOptions "
    cfg += "_Angle=0 "
    cfg += "_AspectRatio=0 "
    cfg += "_Distance=0.0 "
    cfg += "_Density=0.5 "
    cfg += "_Grid=0 "
    cfg += "_MaxEdgeLength=0 "
    cfg += "_MinEdgeLength=0.0001 "
    cfg += "_Enter _Enter" # remove the last _Enter to check if density is set
    return cfg, "obj"

def get_stl_settings_default():
    #[ANGLE,ASPECT RATIO,MAX DIST TO SRF,GRID,DENSITY,MAX EDGE LEN,MIN EDGE LEN]
    #Change list below as needed
    setting_list=[15,0,0.01,16,0,0,0.001]   
    return get_stl_settings(*setting_list)

def get_stl_settings(ang,ar,dist,grid,den,maxL=0,minL=.0001):
    splintcommon.log("Using STL mesh settings")
    e_str = "_ExportFileAs=_Binary "
    e_str+= "_ExportUnfinishedObjects=_Yes "
    e_str+= "_UseSimpleDialog=_No "
    e_str+= "_Enter _DetailedOptions "
    e_str+= "_JaggedSeams=_No "
    e_str+= "_PackTextures=_No "
    e_str+= "_Refine=_Yes "
    e_str+= "_SimplePlane=_Yes "
    # e_str+= "_AdvancedOptions "
    # e_str+= "_Angle={} ".format(ang)
    # e_str+= "_AspectRatio={} ".format(ar)
    # e_str+= "_Distance={} ".format(dist)
    # e_str+= "_Density={} ".format(den)
    # e_str+= "_Grid={} ".format(grid)
    # e_str+= "_MaxEdgeLength={} ".format(maxL)
    # e_str+= "_MinEdgeLength={} ".format(minL)
    e_str+= "_Enter _Enter"
    return e_str, "stl"

def export_mesh_files(meshes, path, filename, debug=False, asObj=True):
    """Exports a collection of meshes to an OBJ file.
    
    Args:
      meshes (list): A list of Rhino.Geometry.Mesh objects.
      path (str): An absolute path pointing to a directory.
      filename (str): A filename (without extension).
      debug (bool): Optional True to print debug information.
    Returns:
      True or False, indicating success or failure.
    """

    sc.doc = Rhino.RhinoDoc.ActiveDoc
    sc.doc.Views.RedrawEnabled = True # JG - False
    if debug: 
        now = time.process_time()
        elapsed = 0.0
        
    # Create a temporary layer
    splintcommon.log(f"export_mesh_files: Creating temp layer")
    layer = "".join(random.choice(string.ascii_uppercase) for _ in range(9))
    layer_index = add_layer(layer)
    if debug: 
        then, now = now, time.process_time()
        elapsed += now - then
        splintcommon.log("Creating temporary layer: {0:.4f} seconds".format(now-then))
        
    # Bake the temporary mesh(es)
    splintcommon.log(f"export_mesh_files: Baking temp mesh(es)")
    mesh_ids = [bake_mesh(layer, mesh) for mesh in meshes]
    if debug: 
        then, now = now, time.process_time()
        elapsed += now - then
        splintcommon.log("Creating temporary mesh(es): {0:.4f} seconds".format(now-then))
    
    # Unselect all objects in the scene
    sc.doc.Objects.UnselectAll()
    # Select the baked mesh object(s)
    for mid in mesh_ids:
        sc.doc.Objects.Select(mid)
    if debug: 
        then, now = now, time.process_time()
        elapsed += now - then
        splintcommon.log("Unselecting and selecting: {0:.4f} seconds".format(now-then))
    
    # Export the selected mesh object(s) to mesh file
    splintcommon.log(f"export_mesh_files: exporting to file")
    export_config, export_extension = get_obj_settings() if asObj else get_stl_settings_default()
    export_fname = "{}.{}".format(filename, export_extension)
    export_fpath = Path(os.path.join(path, export_fname))
    splintcommon.log(f"export_mesh_files: Export Values: {export_fname=} {export_fpath=}")
    
    if export_fpath.exists():
        splintcommon.log(f"export_mesh_files: REMOVING EXISTING MESH FILE: {export_fpath}")
        export_fpath.unlink()
        time.sleep(1.0)
        splintcommon.log(f"export_mesh_files: testing... MeshStillExists:{export_fpath.exists()}")

    splintcommon.log(f"export_mesh_files: exporting to file")

    cmd = '_-Export _Pause "{}" {} _Enter'.format(export_fpath, export_config) # _Enter
    # see: https://discourse.mcneel.com/t/export-command-line-options/87537/5
    splintcommon.log(f"export_mesh_files: RUNNING cmd: '{cmd}'")
    
    #start = Rhino.DocObjects.RhinoObject.NextRuntimeSerialNumber
    rc = Rhino.RhinoApp.RunScript(cmd, True)

    splintcommon.log(f"export_mesh_files: Completion {rc=}")

    #end = Rhino.DocObjects.RhinoObject.NextRuntimeSerialNumber
    #global __command_serial_numbers
    #__command_serial_numbers = None
    #if start != end:
        #__command_serial_numbers = (start, end)
    
    if debug: 
        then, now = now, time.process_time()
        elapsed += now - then
        splintcommon.log("Exporting Mesh Result: {0:.4f} seconds result={1}".format(now-then, rc))
    
    # Delete the temporary layer and meshes
    splintcommon.log(f"export_mesh_files: cleaning up temp layer")
    delete_layer(layer)
    
    if debug: 
        then, now = now, time.process_time()
        elapsed += now - then
        splintcommon.log("Cleaning up: {0:.4f} seconds\n".format(now-then))
        splintcommon.log("Total elapsed: {0:.4f} seconds".format(elapsed))

    sc.doc.Views.RedrawEnabled = True

    splintcommon.log(f"export_mesh_files: Returning result: {rc=}")

    return rc

def saveMeshToFile(inputMesh, directory, rootFilename):
    try:
        splintcommon.log(f"inputMesh type: {inputMesh}")
        splintcommon.log(f"{directory=}")
        splintcommon.log(f"{rootFilename=}")
        
        if inputMesh is None or directory is None or rootFilename is None:        
            raise ValueError("Missing required inputs for saving file")

        #TODO, Validate the path more completely
        if "." in directory or "." in rootFilename:
            raise ValueError(f"Path must not contain dot character: {directory}")

        result = export_mesh_files([inputMesh], directory, rootFilename, True, False)

        if not result:
            raise ValueError(f"FAIL: mesh export failed. {result=}")
        else:
            splintcommon.log(f'SUCCESS: Saved to {rootFilename} in {directory}')
            splintcommon.confirm_job_is_processed_and_exit(jobname, True, "mesh exported normally")

    except Exception as e:
        errMsg = f"Exception: {traceback.format_exc()}"
        splintcommon.log(errMsg)
        splintcommon.confirm_job_is_processed_and_exit(jobname, False, errMsg)

if geo_input is None:
    message = f"No mesh input To Process {geo_input=}"
    splintcommon.log(message)
    splintcommon.confirm_job_is_processed_and_exit(jobname, False, message)
else:
    saveMeshToFile(geo_input, output_file_dir, jobname)
# ---------- end savemeshpy ----------
panel_8 = Panel(savemeshpy)

# ----
# Preview Steps
side_cutter_volume_2 = Brep(side_cutter_volume)
side_cutter_surface_2 = Surface(side_cutter_surface)
inner_finger_form = Brep(inner_shell_brep_3)
preform_barrel = Brep(finger_model_rotate.Geometry)
splint_w_direction_2 = Brep(splint_w_direction)
splint_body_smooth = Mesh(final_smooth_splint)
merge_3 = Merge(Data1=preform_barrel, Data2=side_cutter_surface_2)  # -> flatten(Result)
merge_4 = Merge(Data1=preform_barrel, Data2=side_cutter_volume_2)  # -> flatten(Result)
merge_5 = Merge(Data1=splint_body_smooth)  # -> flatten(Result)
merge_6 = Merge(Data1=comfort_trimmed_splint_brep_3)  # -> flatten(Result)
move_16 = Move(Geometry=merge_3, Motion="120, 0, 0")  # -> Geometry, Transform
move_17 = Move(Geometry=inner_finger_form, Motion="60, 0, 0")  # -> Geometry, Transform
move_18 = Move(Geometry=merge_4, Motion="180, 0, 0")  # -> Geometry, Transform
move_19 = Move(Geometry=merge_5, Motion="340, 0, 0")  # -> Geometry, Transform
move_20 = Move(Geometry=merge_6, Motion="240, 0, 0")  # -> Geometry, Transform

merge_7 = Merge(Data1=splint_w_direction_2)  # -> flatten(Result)
move_21 = Move(Geometry=merge_7, Motion="300, 0, 0")  # -> Geometry, Transform

merge_8 = Merge(
    Data1=move_17.Geometry,
    Data2=move_16.Geometry,
    Data3=move_18.Geometry,
    Data4=move_20.Geometry,
    Data5=move_21.Geometry,
    Data6=move_19.Geometry)  # -> flatten(Result)
random_color = RandomColor(Data=merge_8, Seed=2, FastMode=False)
custom_preview = CustomPreview(Geometry=merge_8, Material=random_color)

# ==== cluster ReliableUnionCL
# Trim Solid is not always working
seam_alignment_line = ClusterInput()  # disabled
join_axis_vector = ClusterInput()  # disabled
brep1 = ClusterInput()
brep2 = ClusterInput()
brep1_2 = Brep(brep1)
brep2_2 = Brep(brep2)
seam_alignment_line_2 = Line(seam_alignment_line)  # disabled
join_axis_vector_2 = Vector(join_axis_vector)  # disabled
number_slider = Slider(0, range=0..1)  # disabled
reverse = Reverse(Vector=join_axis_vector_2)  # disabled
brepunion = Python3Script(BrepA=brep1_2, BrepB=brep2_2)  # -> UnionReport, UnionResult; inputs BrepA: Brep, BrepB: Brep
# ---------- brepunion: Python ----------
# This file represents a stub for a GhPython component in Grasshopper.
# It sets up the environment to import and use the splintcommon or other external modules.

from pathlib import Path
import sys
from importlib import reload #FOR DEV ONLY
import time

# In normal GH doc
ghFileDir = None
try:
    ghFileDir = str(Path.joinpath(Path(ghenv.Component.OnPingDocument().FilePath).resolve().parents[0], "src"))
except:
    # In GH Cluster
    ghFileDir = str(Path.joinpath(Path(ghenv.Component.OnPingDocument().Owner.OnPingDocument().FilePath).resolve().parents[0], "src"))

print(f"{ghFileDir=}")

if ghFileDir not in sys.path:
    print("ghFileDir needed to be included")
    sys.path.append(ghFileDir)

import splintcommon
reload(splintcommon) #FOR DEV ONLY

#splintcommon module is now available for use in this GhPython component
splintcommon.log(f'GhPython Node initialized at {time.ctime()}')

import BrepUnion
reload(BrepUnion)

UnionResult, success, method_used = BrepUnion.robust_brep_union(BrepA, BrepB)

if not success:
    raise Exception(f"Union failed! {method_used}")
# ---------- end brepunion ----------
panel = Panel(brepunion.UnionReport)
merge = Merge(Data1=brep1_2, Data2=brep2_2)  # -> flatten(Result); disabled
unionresult = ClusterOutput(brepunion.UnionResult)  # disabled
unionreport = ClusterOutput(brepunion.UnionReport)
solid_union = SolidUnion(Breps=merge)  # -> flatten(Result); disabled
panel_2 = Panel(solid_union)  # disabled
brepinspect = Python3Script(brepToTest=solid_union)  # -> out, isUsable; inputs brepToTest: Brep; disabled
# ---------- brepinspect: Python ----------
# This file represents a stub for a GhPython component in Grasshopper.
# It sets up the environment to import and use the splintcommon or other external modules.

from pathlib import Path
import sys
from importlib import reload #FOR DEV ONLY
import time

# In normal GH doc
#ghFileDir = str(Path.joinpath(Path(ghenv.Component.OnPingDocument().FilePath).resolve().parents[0], "src"))
# In GH Cluster
ghFileDir = str(Path.joinpath(Path(ghenv.Component.OnPingDocument().Owner.OnPingDocument().FilePath).resolve().parents[0], "src"))

print(f"{ghFileDir=}")

if ghFileDir not in sys.path:
    print("ghFileDir needed to be included")
    sys.path.append(ghFileDir)

import splintcommon
reload(splintcommon) #FOR DEV ONLY

#splintcommon module is now available for use in this GhPython component
splintcommon.log(f'GhPython Node initialized at {time.ctime()}')

import BrepInspect
reload(BrepInspect)

isUsable = BrepInspect.inspect_solid_brep(brepToTest)
# ---------- end brepinspect ----------
check_1_exists = Python3Script(geo=solid_union)  # -> out, doesExist, doesntExist; inputs geo: list of GeometryBase; disabled
# ---------- check_1_exists: Python ----------
from Rhino.Geometry import Brep

print(f"{geo=} type={type(geo)} v1.00")

isExisting = False

if geo is None:
    print("geo is None (root)")
    isExisting = False
elif type(geo) is Brep:
    print("geo is Brep. Yay.")
    isExisting = True
elif hasattr(geo, '__getitem__'):
    print(f"geo len={len(geo)}")
    if len(geo) > 0 and geo[0] is None:
        print(f"geo[0] is None len={len(geo)}")
        isExisting = False
    else:
        isExisting = len(geo) == 1
        print(f"geo is list of {len(geo)} len. {isExisting=}")
else:
    print("fall through no recognized type")

doesExist = isExisting
doesntExist = not isExisting
print(f"{doesExist=} {doesntExist=}")
# ---------- end check_1_exists ----------
pass_items_py = Python3Script(passItems=check_1_exists.doesntExist, brep1=brep1_2, brep2=brep2_2)  # -> out, out_brep1, out_brep2; inputs brep1: Brep, brep2: Brep; disabled
# ---------- pass_items_py: Python ----------
if passItems:
    out_brep1 = brep1
    out_brep2 = brep2
    print("Items passed")
else:
    out_brep1 = None
    out_brep2 = None
    print("Items not passed")
# ---------- end pass_items_py ----------
panel_3 = Panel(pass_items_py.out)  # disabled
brepunion_2 = Python3Script(BrepA=pass_items_py.out_brep1, BrepB=pass_items_py.out_brep2)  # -> out, UnionResult; inputs BrepA: Brep, BrepB: Brep; disabled
# ---------- brepunion_2: Python ----------
# This file represents a stub for a GhPython component in Grasshopper.
# It sets up the environment to import and use the splintcommon or other external modules.

from pathlib import Path
import sys
from importlib import reload #FOR DEV ONLY
import time

# In normal GH doc
ghFileDir = None
try:
    ghFileDir = str(Path.joinpath(Path(ghenv.Component.OnPingDocument().FilePath).resolve().parents[0], "src"))
except:
    # In GH Cluster
    ghFileDir = str(Path.joinpath(Path(ghenv.Component.OnPingDocument().Owner.OnPingDocument().FilePath).resolve().parents[0], "src"))

print(f"{ghFileDir=}")

if ghFileDir not in sys.path:
    print("ghFileDir needed to be included")
    sys.path.append(ghFileDir)

import splintcommon
reload(splintcommon) #FOR DEV ONLY

#splintcommon module is now available for use in this GhPython component
splintcommon.log(f'GhPython Node initialized at {time.ctime()}')

import BrepUnion
reload(BrepUnion)

UnionResult = BrepUnion.robust_brep_union(BrepA, BrepB)
# ---------- end brepunion_2 ----------
panel_4 = Panel(brepunion_2.out)  # disabled
check_1_exists_2 = Python3Script(geo=brepunion_2.UnionResult)  # -> out, doesExist, doesntExist; inputs geo: list of GeometryBase; disabled; same code as check_1_exists
pass_items_py_2 = Python3Script(passItems=check_1_exists_2.doesntExist, brep1=brep1_2, brep2=brep2_2)  # -> out, out_brep1, out_brep2; inputs brep1: Brep, brep2: Brep; disabled; same code as pass_items_py
python_3_script = Python3Script(BrepA=pass_items_py_2.out_brep1, BrepB=pass_items_py_2.out_brep2)  # -> out, FixedBrepA, FixedBrepB, UnionResult; inputs BrepA: Brep, BrepB: Brep; disabled
# ---------- python_3_script: Python ----------
# This file represents a stub for a GhPython component in Grasshopper.
# It sets up the environment to import and use the splintcommon or other external modules.

from pathlib import Path
import sys
from importlib import reload #FOR DEV ONLY
import time

# print("DEBUG")
# print(ghenv.Component.OnPingDocument().Owner.OnPingDocument())
# print("DEBUG END")

ghFileDir = str(Path.joinpath(Path(ghenv.Component.OnPingDocument().Owner.OnPingDocument().FilePath).resolve().parents[0], "src"))
print(f"{ghFileDir=}")

if ghFileDir not in sys.path:
    print("ghFileDir needed to be included")
    sys.path.append(ghFileDir)

import splintcommon
reload(splintcommon) #FOR DEV ONLY

#splintcommon module is now available for use in this GhPython component
splintcommon.log(f'GhPython Node initialized at {time.ctime()}')

import BooleanUnionDiagnostic
reload(BooleanUnionDiagnostic)

FixedBrepA, FixedBrepB, UnionResult = BooleanUnionDiagnostic.do_diagnostic_solid_union(BrepA, BrepB, None, True)
# ---------- end python_3_script ----------
panel_5 = Panel(pass_items_py_2.out)  # disabled
panel_6 = Panel(python_3_script.out)  # disabled
deconstruct_brep = DeconstructBrep(Brep=python_3_script.FixedBrepA)  # -> Faces, Edges, Vertices; disabled
deconstruct_brep_2 = DeconstructBrep(Brep=python_3_script.FixedBrepB)  # -> Faces, Edges, Vertices; disabled
brep_join = BrepJoin(Breps=deconstruct_brep_2.Faces)  # -> Breps, Closed; disabled
brep_join_2 = BrepJoin(Breps=deconstruct_brep.Faces)  # -> Breps, Closed; disabled
merge_2 = Merge(Data1=brep_join_2.Breps, Data2=brep_join.Breps)  # -> flatten(Result); disabled
solid_union_2 = SolidUnion(Breps=merge_2)  # -> flatten(Result); disabled
panel_7 = Panel(brepinspect.isUsable)  # disabled
loft_options = LoftOptions(Closed=False, Adjust=False, Rebuild=0, Refit=0, Type=0)  # disabled
panel_8 = Panel(check_1_exists.out)  # disabled
panel_9 = Panel(check_1_exists.doesntExist)  # disabled
panel_10 = Panel(solid_union_2)  # disabled
panel_11 = Panel(brepinspect.out)  # disabled
check_1_exists_3 = Python3Script(geo=solid_union_2)  # -> out, doesExist, doesntExist; inputs geo: list of GeometryBase; disabled; same code as check_1_exists
pass_items_py_3 = Python3Script(passItems=check_1_exists_3.doesntExist, brep1=brep1_2, brep2=brep2_2)  # -> out, out_brep1, out_brep2; inputs brep1: Brep, brep2: Brep; disabled; same code as pass_items_py
trim_solid = TrimSolid(Shape=pass_items_py_3.out_brep2, Cutters=pass_items_py_3.out_brep1)  # disabled
trim_solid_2 = TrimSolid(Shape=pass_items_py_3.out_brep1, Cutters=pass_items_py_3.out_brep2)  # disabled
list_item = ListItem(List=trim_solid, Index=number_slider, Wrap=True)  # disabled
directional_trim = DirectionalTrim(single_opening_brep=trim_solid_2, trim_shift_vector=join_axis_vector_2)  # -> trimmed_brep_2, naked_curve; disabled
directional_trim_2 = DirectionalTrim(single_opening_brep=list_item, trim_shift_vector=reverse)  # -> flatten(trimmed_brep_2), naked_curve; disabled
curve = Curve(directional_trim_2.naked_curve)  # disabled
curve_2 = Curve(directional_trim.naked_curve)  # disabled
flip_curve = FlipCurve(Curve=curve, Guide=curve_2)  # -> Curve, Flag; disabled
merge_3 = Merge(Data1=curve_2, Data2=flip_curve.Curve)  # -> flatten(Result); disabled
trimmed_brep = Brep(directional_trim_2.trimmed_brep_2)  # disabled
trimmed_brep_2 = Brep(directional_trim.trimmed_brep_2)  # disabled
curve_align_curve_seams = CurveAlignCurveSeams(Curves=merge_3, Guide=seam_alignment_line_2, Snap=False)  # -> Aligned, Points, ResultBoolean; disabled
loft = Loft(Curves=curve_align_curve_seams.Aligned, Options=loft_options)  # disabled
merge_4 = Merge(Data1=trimmed_brep_2, Data2=loft, Data3=trimmed_brep)  # -> flatten(Result); disabled
brep_join_3 = BrepJoin(Breps=merge_4)  # -> Breps, Closed; disabled
panel_12 = Panel(check_1_exists_2.out)  # disabled
panel_13 = Panel(check_1_exists_2.doesntExist)  # disabled
list_item_2 = ListItem(List=brep_join_3.Breps, Index=0, Wrap=True)  # disabled
check_1_exists_4 = Python3Script(geo=list_item_2)  # -> out, doesExist, doesntExist; inputs geo: list of GeometryBase; disabled; same code as check_1_exists
python_3_script_2 = Python3Script(
    method0Exists=check_1_exists.doesExist,
    method0Geo=solid_union,
    method1Exists=check_1_exists_2.doesExist,
    method1Geo=brepunion_2.UnionResult,
    method2Exists=check_1_exists_3.doesExist,
    method2Geo=solid_union_2,
    method3Exists=check_1_exists_4.doesExist,
    method3Geo=list_item_2)  # -> out, result; inputs method0Exists: Boolean, method0Geo: GeometryBase, method1Exists: Boolean, method1Geo: GeometryBase, method2Exists: Boolean, method2Geo: GeometryBase, method3Geo: GeometryBase; disabled
# ---------- python_3_script_2: Python ----------
if method0Exists:
    result = method0Geo
    print("Method 0 Wins")
elif method1Exists:
    result = method1Geo
    print("Method 1 Wins")
elif method2Exists:
    result = method2Geo
    print("Method 2 Wins")
elif method3Exists:
    result = method3Geo
    print("Method 3 Wins")
else:
    print("NOTHING WORKED!!!")
# ---------- end python_3_script_2 ----------

# ==== cluster ConeCreator
splint_center_point = ClusterInput()
point_c = ClusterInput()
point_b = ClusterInput()
point_a = ClusterInput()
splint_center_point_2 = Point(splint_center_point)
point_a_2 = Point(point_a)
point_c_2 = Point(point_c)
point_b_2 = Point(point_b)
splint_center_point_3 = Point(splint_center_point)
ext_ln_pts = ExtLnPts(startpoint=splint_center_point_3, midpoint=point_a_2, extensiondist="-5")
ext_ln_pts_2 = ExtLnPts(startpoint=splint_center_point_3, midpoint=point_b_2, extensiondist="-5")
ext_ln_pts_3 = ExtLnPts(startpoint=splint_center_point_3, midpoint=point_c_2, extensiondist="-5")
ext_ln_pts_4 = ExtLnPts(startpoint=splint_center_point_2, midpoint=point_a_2, extensiondist="5")
ext_ln_pts_5 = ExtLnPts(startpoint=splint_center_point_2, midpoint=point_b_2, extensiondist="5")
ext_ln_pts_6 = ExtLnPts(startpoint=splint_center_point_2, midpoint=point_c_2, extensiondist="5")
point_cx = Point(ext_ln_pts_3)
point_cx_2 = Point(ext_ln_pts_6)
point_bx = Point(ext_ln_pts_2)
point_ax = Point(ext_ln_pts)
point_bx_2 = Point(ext_ln_pts_5)
point_ax_2 = Point(ext_ln_pts_4)
circle_3pt = Circle3Pt(PointA=point_cx, PointB=point_bx, PointC=point_ax)  # -> Circle, Plane, Radius
circle_3pt_2 = Circle3Pt(PointA=point_cx_2, PointB=point_bx_2, PointC=point_ax_2)  # -> Circle, Plane, Radius
loft = Loft(
    Curves=[circle_3pt_2.Circle, circle_3pt.Circle],
    Options={Adjust=False, Closed=False, LoftEnds=0, LoftSimp=0, LoftType=0, Rebuild=10, Refit=0.01})
cap_holes = CapHoles(Brep=loft)
brep = ClusterOutput(cap_holes)

# ==== cluster VizVector
arrowlen = ClusterInput()
text = ClusterInput()
arrowlen_2 = Number(arrowlen)
text_2 = Text(text)
start = ClusterInput()
direction = ClusterInput()
division = Division(A=arrowlen_2, B="4")
line_sdl = LineSDL(Start=start, Direction=direction, Length=arrowlen_2)
end_points = EndPoints(Curve=line_sdl)  # -> Start, End
line = ClusterOutput(line_sdl)
plane_normal = PlaneNormal(Origin=end_points.End, ZAxis=line_sdl)
annotation_dot = AnnotationDot(Location=end_points.End, PrimaryText=text_2)  # -> AnnotationDot, Location, PrimaryText, TextHeight
cone = Cone(Base=plane_normal, Radius=division, Length=division)  # -> Cone, Tip
cone_2 = ClusterOutput(cone.Cone)
annotation_dot_2 = ClusterOutput(annotation_dot.AnnotationDot)

# ==== cluster VizPlane
plane = ClusterInput()
deconstruct_plane = DeconstructPlane(Plane=plane)  # -> Origin, XAxis, YAxis, ZAxis
arrow = VizVector(start=deconstruct_plane.Origin, direction=deconstruct_plane.XAxis, arrowlen="3", text="X")  # -> cone_2, line, annotation_dot_2
arrow_2 = VizVector(start=deconstruct_plane.Origin, direction=deconstruct_plane.YAxis, arrowlen="3", text="Y")  # -> cone_2, line, annotation_dot_2
arrow_3 = VizVector(start=deconstruct_plane.Origin, direction=deconstruct_plane.ZAxis, arrowlen="3", text="Z")  # -> cone_2, line, annotation_dot_2
tip = Brep([arrow.cone_2, arrow_2.cone_2, arrow_3.cone_2])
line = Line([arrow.line, arrow_2.line, arrow_3.line])
annotation_dot = AnnotationDot([arrow.annotation_dot_2, arrow_2.annotation_dot_2, arrow_3.annotation_dot_2])
tip_2 = ClusterOutput(tip)
line_2 = ClusterOutput(line)
annotation_dot_2 = ClusterOutput(annotation_dot)

# ==== cluster Cluster
trim_rectangles = ClusterInput()
point_a = ClusterInput()
point_b = ClusterInput()
point_c = ClusterInput()
trim_rectangles_2 = Rectangle(trim_rectangles)
point_b_2 = Point(point_b)
point_a_2 = Point(point_a)
point_c_2 = Point(point_c)
circle_3pt = Circle3Pt(PointA=point_a_2, PointB=point_b_2, PointC=point_c_2)  # -> Circle, Plane, Radius
offset_curve = OffsetCurve(Curve=circle_3pt.Circle, Distance=1, Corners=1)
merge = Merge(Data1=offset_curve, Data2=circle_3pt.Circle)  # -> flatten(Result)
boundary_surfaces = BoundarySurfaces(Edges=merge)
input_surface_brep = Brep(boundary_surfaces)
area = Area(Geometry=trim_rectangles_2)  # -> Area, Centroid
trim_face_plane = Plane(circle_3pt.Plane)
scale = Scale(Geometry=trim_rectangles_2, Center=area.Centroid, Factor="5")  # -> Geometry, Transform
deconstruct_plane = DeconstructPlane(Plane=trim_face_plane)  # -> Origin, XAxis, YAxis, ZAxis
unit_z = UnitZ(Factor="-1")
negative = Negative(Value=deconstruct_plane.ZAxis)
trim_surface = Python3Script(input_surface=input_surface_brep, trim_rectangles=scale.Geometry, keep_direction=unit_z, x=Toggle(False))  # -> out, result_surface; inputs input_surface: Brep, trim_rectangles: list of Brep
# ---------- trim_surface: Python ----------
# This file represents a stub for a GhPython component in Grasshopper.
# It sets up the environment to import and use the splintcommon or other external modules.

from pathlib import Path
import sys
from importlib import reload #FOR DEV
import time

# In normal GH doc
ghFileDir = None
try:
    ghFileDir = str(Path.joinpath(Path(ghenv.Component.OnPingDocument().FilePath).resolve().parents[0], "src"))
except:
    # In GH Cluster
    ghFileDir = str(Path.joinpath(Path(ghenv.Component.OnPingDocument().Owner.OnPingDocument().FilePath).resolve().parents[0], "src"))

print(f"{ghFileDir=}")

if ghFileDir not in sys.path:
    print("ghFileDir needed to be included")
    sys.path.append(ghFileDir)

import splintcommon
reload(splintcommon) #FOR DEV

#splintcommon module is now available for use in this GhPython component
splintcommon.log(f'GhPython Node initialized at {time.ctime()}')

import Rhino.Geometry as rg
import FeatureIdentification as fi
reload(fi)

# trim_planes = [fi.rect2plane(rect) for rect in trim_rectangles]


result_surface = fi.trim_surface_with_direction(
    trim_rectangles,
    input_surface,
    keep_direction
)
# ---------- end trim_surface ----------
multiplication = Multiplication(A=negative, B="20")
extrude = Extrude(Base=trim_surface.result_surface, Direction=multiplication)
move = Move(Geometry=extrude, Motion=deconstruct_plane.ZAxis)  # -> Geometry, Transform
geometry = ClusterOutput(move.Geometry)

# ==== cluster Cluster_2
trim_rectangles = ClusterInput()
point_b = ClusterInput()
point_a = ClusterInput()
point_c = ClusterInput()
trim_rectangles_2 = Rectangle(trim_rectangles)
point_b_2 = Point(point_b)
point_a_2 = Point(point_a)
point_c_2 = Point(point_c)
circle_3pt = Circle3Pt(PointA=point_a_2, PointB=point_b_2, PointC=point_c_2)  # -> Circle, Plane, Radius
offset_curve = OffsetCurve(Curve=circle_3pt.Circle, Distance=1, Corners=1)
merge = Merge(Data1=offset_curve, Data2=circle_3pt.Circle)  # -> flatten(Result)
boundary_surfaces = BoundarySurfaces(Edges=merge)
input_surface_brep = Brep(boundary_surfaces)
area = Area(Geometry=trim_rectangles_2)  # -> Area, Centroid
trim_face_plane = Plane(circle_3pt.Plane)
scale = Scale(Geometry=trim_rectangles_2, Center=area.Centroid, Factor="5")  # -> Geometry, Transform
deconstruct_plane = DeconstructPlane(Plane=trim_face_plane)  # -> Origin, XAxis, YAxis, ZAxis
unit_z = UnitZ(Factor="-1")
negative = Negative(Value=deconstruct_plane.ZAxis)
trim_surface = Python3Script(input_surface=input_surface_brep, trim_rectangles=scale.Geometry, keep_direction=unit_z, x=Toggle(False))  # -> out, result_surface; inputs input_surface: Brep, trim_rectangles: list of Brep; same code as trim_surface
multiplication = Multiplication(A=negative, B="20")
extrude = Extrude(Base=trim_surface.result_surface, Direction=multiplication)
move = Move(Geometry=extrude, Motion=deconstruct_plane.ZAxis)  # -> Geometry, Transform
geometry = ClusterOutput(move.Geometry)

# ==== cluster DirectionalTrim
trim_shift_vector = ClusterInput()
single_opening_brep = ClusterInput()
single_opening_brep_2 = Brep(single_opening_brep)
trim_shift_vector_2 = Vector(trim_shift_vector)
brep_edges = BrepEdges(Brep=single_opening_brep_2)  # -> Naked, Interior, NonManifold
unit_vector = UnitVector(Vector=trim_shift_vector_2)
reverse = Reverse(Vector=unit_vector)
curve = Curve(flatten(brep_edges.Naked))
join_curves = JoinCurves(Curves=curve, Preserve=False)
point = Point("0, 0, 0")
multiplication = Multiplication(A=reverse, B="1000")
multiplication_2 = Multiplication(A=unit_vector, B="1000")
move = Move(Geometry=point, Motion=multiplication)  # -> Geometry, Transform
reparameterize_curve = ReparameterizeCurve(Curve=join_curves)  # -> Reparameterized, Original
line = Line(StartPoint=multiplication, EndPoint=multiplication_2)
divide_curve = DivideCurve(Curve=reparameterize_curve.Reparameterized, Count="10", Kinks=False)  # -> flatten(Points), Tangents, Parameters
plane_fit = PlaneFit(Points=divide_curve.Points)  # -> Plane, Deviation
move_2 = Move(Geometry=plane_fit.Plane, Motion=trim_shift_vector_2)  # -> Geometry, Transform
brep_plane = BrepPlane(Brep=single_opening_brep_2, Plane=move_2.Geometry)  # -> Curves, Points
split_brep = SplitBrep(Brep=single_opening_brep_2, Cutter=brep_plane.Curves)
bounding_box = BoundingBox(Content=split_brep, Plane=PlaneXY(0, 0, 0))  # -> Box, Box_2
volume = Volume(Geometry=bounding_box.Box)  # -> Volume, Centroid
sort_along_curve = SortAlongCurve(Points=volume.Centroid, Curve=line)  # -> Points, Indices
list_item = ListItem(List=sort_along_curve.Indices, Index="-1", Wrap=Toggle(True))
list_item_2 = ListItem(List=split_brep, Index=list_item, Wrap=True)
trimmed_brep = Brep(list_item_2)
brep_edges_2 = BrepEdges(Brep=trimmed_brep)  # -> Naked, Interior, NonManifold
join_curves_2 = JoinCurves(Curves=brep_edges_2.Naked, Preserve=False)
naked_curve = ClusterOutput(join_curves_2)
trimmed_brep_2 = ClusterOutput(trimmed_brep)

# ==== cluster ExtLnPts
extensiondist = ClusterInput()
midpoint = ClusterInput()
startpoint = ClusterInput()
midpoint_2 = Point(midpoint)
startpoint_2 = Point(startpoint)
extensiondist_2 = Number(extensiondist)
line = Line(StartPoint=startpoint_2, EndPoint=midpoint_2)
extend_curve = ExtendCurve(Curve=line, Type=0, Start="0", End=extensiondist_2)
end_points = EndPoints(Curve=extend_curve)  # -> Start, End
endpoint = Point(end_points.End)
endpoint_2 = ClusterOutput(endpoint)
