# Grasshopper definition RelativeMotion.gh (Grasshopper 1.0.8)
# plug-ins: Pufferfish, Wombat

geo_algorithm_name = Panel("RelativeMotion")
# RelativeMotion
is_production_mode = BooleanToggle(True)
toggle_job_make_it_go = BooleanToggle(True)
axial_band_thickness_mm = Panel("1.65")
min_center_gap = Panel("1.5")
support_arc_deg = Panel("45.0")
factoryautomatorpy = Python3Script(is_production_mode=is_production_mode, geo_algorithm_name=geo_algorithm_name, toggleJob=toggle_job_make_it_go)  # -> out, full_perimeter_mm, right_forward_offset_mm, b_left_slit, b_right_slit, band_width_mm, finger_data, root_filename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; inputs is_production_mode: Boolean, toggleJob: Boolean
# ---------- factoryautomatorpy: Python ----------
from pathlib import Path
import sys
from importlib import reload #FOR DEV
import time

ghFileDir = str(Path.joinpath(Path(ghenv.Component.OnPingDocument().FilePath).resolve().parents[0], "src"))
print(f"{ghFileDir=}")

if ghFileDir not in sys.path:
    print("ghFileDir needed to be included")
    sys.path.append(ghFileDir)

import splintcommon
reload(splintcommon) #FOR DEV
from splintcommon import mark_generation_start
mark_generation_start()
splintcommon.log(f'FactoryAutomatorPY Running at: ({time.strftime("%H:%M:%S", time.localtime())})')
# ==================== Component Code ===========================

def float_range(start, stop, count):
    current = start
    step = (stop - start) / (count - 1)
    result_range = []
    for c in range(count):
        result_range.append(start + (step * c))
    return result_range

# job_data, objectID, root_filename, output_dir, raw_data = splintcommon.load_job_data(is_production_mode, geo_algorithm_name)

# This mapping must match the schema of the data in the DB for this geometry type
# c_left_mm = job_data["c_left_mm"]
# c_right_mm = job_data["c_right_mm"]
# full_perimeter_mm = job_data["full_perimeter_mm"]
# right_forward_offset_mm = job_data["right_forward_offset_mm"]
# b_left_slit = job_data.get("b_left_slit", False)
# b_right_slit = job_data.get("b_right_slit", False)
# band_width_mm = job_data.get("band_width_mm", 7.5)
# splintcommon.log(f"Result data {c_left_mm=} {c_right_mm=} {full_perimeter_mm=} {right_forward_offset_mm=} {b_left_slit=} {b_right_slit=}")

sample_raw_data = {
    "is_right_hand": True,
    "finger_data": [
        { 
            "finger_abbr": "if", #just a constant provided for reference, "if" is Index Finger
            "is_included": True, #autogenerated value to indicate that the finger is included in the splint
            "is_anchor_finger": True,
            "p1_mid_circ": 70.0,
            "p1_length": 45.0,
            "pip_neighbor_fwd_offset": 0, #Always 0 for first anchor finger or Index Finger ("if")
            "is_slitted": True, #Only anchor fingers can be slitted
        },
        {
            "finger_abbr": "mf", #just a constant provided for reference, "mf" is Middle Finger
            "is_included": True,
            "is_anchor_finger": False,
            "p1_mid_circ": 71.0,
            "p1_length": 50.0,
            "pip_neighbor_fwd_offset": 5.0, #Relative to if pip location +5 means mf pip is farther distal
            "is_slitted": False,
        },
        {
            "finger_abbr": "rf", #just a constant provided for reference, "rf" is Ring Finger
            "is_included": True,
            "is_anchor_finger": False,
            "p1_mid_circ": 64.0,
            "p1_length": 47.0,
            "pip_neighbor_fwd_offset": -10,
            "is_slitted": False,
        },
        {
            "finger_abbr": "sf", #just a constant provided for reference, "sf" is Small Finger
            "is_included": True, #because the previous rf finger is an anchor this is not included in the splint
            "is_anchor_finger": True,
            "p1_mid_circ": 60.0,
            "p1_length": 40,
            "pip_neighbor_fwd_offset": -11.0,
            "is_slitted": True,            
        }
    ],
    "all_splint_finger_circ": 148.0,
    "relative_elevation_angle": 20.0, #This is relative to the plane established by the two anchor finger centers
    "band_width_mm": 9.0, #thickness of the splint profile extrusion
}

job_data = sample_raw_data

raw_data = splintcommon.gh_encode(job_data)

finger_data = job_data["finger_data"]



# raw_data = splintcommon.gh_encode({
#     "somestring": "hello",
#     "somebool": True,
#     "somenum": 1.010,
# })
# ---------- end factoryautomatorpy ----------
a_a_s_a = Python3Script()  # -> out, raw_data
# ---------- a_a_s_a: Python ----------
from pathlib import Path
import sys
from importlib import reload #FOR DEV
import time

ghFileDir = str(Path.joinpath(Path(ghenv.Component.OnPingDocument().FilePath).resolve().parents[0], "src"))
print(f"{ghFileDir=}")

if ghFileDir not in sys.path:
    print("ghFileDir needed to be included")
    sys.path.append(ghFileDir)

import splintcommon
reload(splintcommon) #FOR DEV

sample_raw_data = {
    "is_right_hand": True,
    "finger_data": [
        { 
            "finger_abbr": "if", #just a constant provided for reference, "if" is Index Finger
            "is_included": True, #autogenerated value to indicate that the finger is included in the splint
            "is_anchor_finger": True,
            "p1_mid_circ": 70.0,
            "p1_length": 45.0,
            "pip_neighbor_fwd_offset": 0, #Always 0 for first anchor finger or Index Finger ("if")
            "is_slitted": True, #Only anchor fingers can be slitted
        },
        {
            "finger_abbr": "mf", #just a constant provided for reference, "mf" is Middle Finger
            "is_included": True,
            "is_anchor_finger": True,
            "p1_mid_circ": 71.0,
            "p1_length": 50.0,
            "pip_neighbor_fwd_offset": 5.0, #Relative to if pip location +5 means mf pip is farther distal
            "is_slitted": False,
        },
        {
            "finger_abbr": "rf", #just a constant provided for reference, "rf" is Ring Finger
            "is_included": True,
            "is_anchor_finger": False,
            "p1_mid_circ": 64.0,
            "p1_length": 47.0,
            "pip_neighbor_fwd_offset": -10,
            "is_slitted": False,
        },
        {
            "finger_abbr": "sf", #just a constant provided for reference, "sf" is Small Finger
            "is_included": True, #because the previous rf finger is an anchor this is not included in the splint
            "is_anchor_finger": True,
            "p1_mid_circ": 60.0,
            "p1_length": 40,
            "pip_neighbor_fwd_offset": -11.0,
            "is_slitted": True,            
        }
    ],
    "all_splint_finger_circ": 148.0,
    "relative_elevation_angle": 20.0, #This is relative to the plane established by the two anchor finger centers
    "band_width_mm": 9.0, #thickness of the splint profile extrusion
}

raw_data = splintcommon.gh_encode(sample_raw_data)
# ---------- end a_a_s_a ----------
min_center_gap_2 = Number(axial_band_thickness_mm)
axial_band_thickness_mm_2 = Number(reverse(axial_band_thickness_mm))
data = Data(a_a_s_a.raw_data)
panel = Panel(factoryautomatorpy.out)
initial_geometry_locations_py = Python3Script(raw_data=data, min_center_gap=min_center_gap_2)  # -> out, mcp_points, p1_lines, p1_circles, p1_cylinders; inputs min_center_gap: Double
# ---------- initial_geometry_locations_py: Python ----------
# This file represents a stub for a GhPython component in Grasshopper.
# It sets up the environment to import and use the splintcommon or other external modules.

from pathlib import Path
import sys
from importlib import reload #FOR DEV
import time

# Walk up through nested clusters to find the root GH document (necessary for use in nested clusters)
doc = ghenv.Component.OnPingDocument()
while not doc.FilePath and doc.Owner:
    doc = doc.Owner.OnPingDocument()
ghFileDir = str(Path(doc.FilePath).resolve().parent / "src")

print(f"{ghFileDir=}")

if ghFileDir not in sys.path:
    print("ghFileDir needed to be included")
    sys.path.append(ghFileDir)

import splintcommon
reload(splintcommon) #FOR DEV
from splintcommon import mark_generation_start
mark_generation_start()

#splintcommon module is now available for use in this GhPython component
component_label = ghenv.Component.NickName or ghenv.Component.Name
component_start_time = time.time()
component_run_token = str(int(component_start_time * 1000))
splintcommon.log(f'[{component_label} run={component_run_token}] GhPython Node initialized at {time.ctime(component_start_time)}')


#Component code here
import json
from pprint import pprint

import RelativeMotion
reload(RelativeMotion)
from RelativeMotion import setup_finger_positions



raw_data = splintcommon.gh_decode_one(raw_data)
# pprint(raw_data, sort_dicts=True, width=100)
print(type(raw_data), raw_data if not isinstance(raw_data, dict) else "dict OK")

print(f"{min_center_gap=}")
mcp_points, p1_lines, p1_circles, p1_cylinders = setup_finger_positions(raw_data, min_center_gap=min_center_gap)


#END Component code
component_elapsed_seconds = time.time() - component_start_time
splintcommon.log(f'[{component_label} run={component_run_token}] GhPython Node completed in {component_elapsed_seconds:.3f}s')
# ---------- end initial_geometry_locations_py ----------
geometry = Geometry(initial_geometry_locations_py.p1_lines)
rotate_supported_fingers_py = Python3Script(
    raw_data=data,
    mcp_points=initial_geometry_locations_py.mcp_points,
    p1_lines=initial_geometry_locations_py.p1_lines,
    p1_circles=initial_geometry_locations_py.p1_circles,
    p1_cylinders=initial_geometry_locations_py.p1_cylinders)  # -> out, mcp_points, p1_lines, p1_circles, p1_cylinders, transforms; inputs mcp_points: list of Point3d, p1_lines: list of Line, p1_circles: list of Circle, p1_cylinders: list of Brep
# ---------- rotate_supported_fingers_py: Python ----------
# This file represents a stub for a GhPython component in Grasshopper.
# It sets up the environment to import and use the splintcommon or other external modules.

from pathlib import Path
import sys
from importlib import reload #FOR DEV
import time

# Walk up through nested clusters to find the root GH document (necessary for use in nested clusters)
doc = ghenv.Component.OnPingDocument()
while not doc.FilePath and doc.Owner:
    doc = doc.Owner.OnPingDocument()
ghFileDir = str(Path(doc.FilePath).resolve().parent / "src")

print(f"{ghFileDir=}")

if ghFileDir not in sys.path:
    print("ghFileDir needed to be included")
    sys.path.append(ghFileDir)

import splintcommon
reload(splintcommon) #FOR DEV
from splintcommon import mark_generation_start
mark_generation_start()

#splintcommon module is now available for use in this GhPython component
component_label = ghenv.Component.NickName or ghenv.Component.Name
component_start_time = time.time()
component_run_token = str(int(component_start_time * 1000))
splintcommon.log(f'[{component_label} run={component_run_token}] GhPython Node initialized at {time.ctime(component_start_time)}')


#Component code here
import json
from pprint import pprint

import RelativeMotion
reload(RelativeMotion)
from RelativeMotion import elevate_supported_fingers


raw_data = splintcommon.gh_decode_one(raw_data)
# pprint(raw_data, sort_dicts=True, width=100)
print(type(raw_data), raw_data if not isinstance(raw_data, dict) else "dict OK")

mcp_points, p1_lines, p1_circles, p1_cylinders, transforms = elevate_supported_fingers(raw_data, mcp_points, p1_lines, p1_circles, p1_cylinders)


#END Component code
component_elapsed_seconds = time.time() - component_start_time
splintcommon.log(f'[{component_label} run={component_run_token}] GhPython Node completed in {component_elapsed_seconds:.3f}s')
# ---------- end rotate_supported_fingers_py ----------
geo_algorithm_name_2 = Panel("RelativeMotion")  # disabled
is_production_mode_2 = BooleanToggle(True)  # disabled
toggle_job_make_it_go_2 = BooleanToggle(True)  # disabled
find_profile_plane_py = Python3Script(
    raw_data=data,
    mcp_points=rotate_supported_fingers_py.mcp_points,
    p1_lines=rotate_supported_fingers_py.p1_lines,
    p1_circles=rotate_supported_fingers_py.p1_circles,
    p1_cylinders=rotate_supported_fingers_py.p1_cylinders)  # -> out, profile_plane; inputs mcp_points: list of Point3d, p1_lines: list of Line, p1_circles: list of Circle, p1_cylinders: list of Brep
# ---------- find_profile_plane_py: Python ----------
# This file represents a stub for a GhPython component in Grasshopper.
# It sets up the environment to import and use the splintcommon or other external modules.

from pathlib import Path
import sys
from importlib import reload #FOR DEV
import time

# Walk up through nested clusters to find the root GH document (necessary for use in nested clusters)
doc = ghenv.Component.OnPingDocument()
while not doc.FilePath and doc.Owner:
    doc = doc.Owner.OnPingDocument()
ghFileDir = str(Path(doc.FilePath).resolve().parent / "src")

print(f"{ghFileDir=}")

if ghFileDir not in sys.path:
    print("ghFileDir needed to be included")
    sys.path.append(ghFileDir)

import splintcommon
reload(splintcommon) #FOR DEV
from splintcommon import mark_generation_start
mark_generation_start()

#splintcommon module is now available for use in this GhPython component
component_label = ghenv.Component.NickName or ghenv.Component.Name
component_start_time = time.time()
component_run_token = str(int(component_start_time * 1000))
splintcommon.log(f'[{component_label} run={component_run_token}] GhPython Node initialized at {time.ctime(component_start_time)}')


#Component code here
import json
from pprint import pprint

import RelativeMotion
reload(RelativeMotion)
from RelativeMotion import build_profile_plane


raw_data = splintcommon.gh_decode_one(raw_data)
# pprint(raw_data, sort_dicts=True, width=100)
print(type(raw_data), raw_data if not isinstance(raw_data, dict) else "dict OK")

# mcp_points, p1_lines, p1_circles, p1_cylinders, transforms = elevate_supported_fingers(raw_data, mcp_points, p1_lines, p1_circles, p1_cylinders)
profile_plane = build_profile_plane(raw_data, p1_circles)



#END Component code
component_elapsed_seconds = time.time() - component_start_time
splintcommon.log(f'[{component_label} run={component_run_token}] GhPython Node completed in {component_elapsed_seconds:.3f}s')
# ---------- end find_profile_plane_py ----------
axial_band_thickness_mm_3 = Panel("1.65")  # disabled
unit_x = UnitX(Factor="10")
support_arc_deg_2 = Number(support_arc_deg)
factoryautomatorpy_2 = Python3Script(is_production_mode=is_production_mode_2, geo_algorithm_name=geo_algorithm_name_2, toggleJob=toggle_job_make_it_go_2)  # -> out, full_perimeter_mm, right_forward_offset_mm, b_left_slit, b_right_slit, band_width_mm, finger_data, root_filename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; inputs is_production_mode: Boolean, toggleJob: Boolean; disabled; same code as factoryautomatorpy
brep_plane = BrepPlane(Brep=rotate_supported_fingers_py.p1_cylinders, Plane=find_profile_plane_py.profile_plane)  # -> Curves, Points
move = Move(Geometry=find_profile_plane_py.profile_plane, Motion=unit_x)  # -> Geometry, Transform
find_profile_plane_py_2 = Python3Script(
    raw_data=data,
    mcp_points=rotate_supported_fingers_py.mcp_points,
    p1_lines=rotate_supported_fingers_py.p1_lines,
    p1_circles=rotate_supported_fingers_py.p1_circles,
    p1_cylinders=rotate_supported_fingers_py.p1_cylinders,
    profile_plane=find_profile_plane_py.profile_plane,
    support_arc_deg=support_arc_deg_2)  # -> out, profile_plane, full_intersection_curves, preserved_intersection_curves; inputs mcp_points: list of Point3d, p1_lines: list of Line, p1_circles: list of Circle, p1_cylinders: list of Brep, support_arc_deg: Double
# ---------- find_profile_plane_py_2: Python ----------
# This file represents a stub for a GhPython component in Grasshopper.
# It sets up the environment to import and use the splintcommon or other external modules.

from pathlib import Path
import sys
from importlib import reload #FOR DEV
import time

# Walk up through nested clusters to find the root GH document (necessary for use in nested clusters)
doc = ghenv.Component.OnPingDocument()
while not doc.FilePath and doc.Owner:
    doc = doc.Owner.OnPingDocument()
ghFileDir = str(Path(doc.FilePath).resolve().parent / "src")

print(f"{ghFileDir=}")

if ghFileDir not in sys.path:
    print("ghFileDir needed to be included")
    sys.path.append(ghFileDir)

import splintcommon
reload(splintcommon) #FOR DEV
from splintcommon import mark_generation_start
mark_generation_start()

#splintcommon module is now available for use in this GhPython component
component_label = ghenv.Component.NickName or ghenv.Component.Name
component_start_time = time.time()
component_run_token = str(int(component_start_time * 1000))
splintcommon.log(f'[{component_label} run={component_run_token}] GhPython Node initialized at {time.ctime(component_start_time)}')


#Component code here
import json
from pprint import pprint

import RelativeMotion
reload(RelativeMotion)
from RelativeMotion import extract_finger_cross_sections


raw_data = splintcommon.gh_decode_one(raw_data)
# pprint(raw_data, sort_dicts=True, width=100)
print(type(raw_data), raw_data if not isinstance(raw_data, dict) else "dict OK")


full_intersection_curves, preserved_intersection_curves = extract_finger_cross_sections(
    raw_data, profile_plane, p1_cylinders, p1_lines, support_arc_deg=support_arc_deg )

#END Component code
component_elapsed_seconds = time.time() - component_start_time
splintcommon.log(f'[{component_label} run={component_run_token}] GhPython Node completed in {component_elapsed_seconds:.3f}s')
# ---------- end find_profile_plane_py_2 ----------
find_profile_plane_py_3 = Python3Script(
    raw_data=data,
    mcp_points=rotate_supported_fingers_py.mcp_points,
    p1_lines=rotate_supported_fingers_py.p1_lines,
    p1_circles=rotate_supported_fingers_py.p1_circles,
    p1_cylinders=rotate_supported_fingers_py.p1_cylinders,
    profile_plane=move.Geometry,
    support_arc_deg=support_arc_deg_2)  # -> out, profile_plane, full_intersection_curves, preserved_intersection_curves; inputs mcp_points: list of Point3d, p1_lines: list of Line, p1_circles: list of Circle, p1_cylinders: list of Brep, support_arc_deg: Double; same code as find_profile_plane_py_2
full_intersection_curves = Curve(find_profile_plane_py_2.full_intersection_curves)
preserved_intersection_curves = Curve(find_profile_plane_py_2.preserved_intersection_curves)
find_profile_plane_py_4 = Python3Script(
    raw_data=data,
    mcp_points=rotate_supported_fingers_py.mcp_points,
    p1_lines=rotate_supported_fingers_py.p1_lines,
    p1_circles=rotate_supported_fingers_py.p1_circles,
    p1_cylinders=rotate_supported_fingers_py.p1_cylinders,
    profile_plane=find_profile_plane_py.profile_plane,
    support_arc_deg=support_arc_deg_2,
    full_intersection_curves=find_profile_plane_py_2.full_intersection_curves,
    preserved_intersection_curves=find_profile_plane_py_2.preserved_intersection_curves,
    anchor_bridge_radius_mm="3",
    support_bridge_radius_mm="10")  # -> out, exterior_anchor_rings, pos_hemis, neg_hemis, walk_preview, closed_profile, bridge_curves; inputs mcp_points: list of Point3d, p1_lines: list of Line, p1_circles: list of Circle, p1_cylinders: list of Brep, profile_plane: Plane, support_arc_deg: Double, full_intersection_curves: list of Curve, preserved_intersection_curves: list of Curve, anchor_bridge_radius_mm: Double, support_bridge_radius_mm: Double
# ---------- find_profile_plane_py_4: Python ----------
# This file represents a stub for a GhPython component in Grasshopper.
# It sets up the environment to import and use the splintcommon or other external modules.

from pathlib import Path
import sys
from importlib import reload #FOR DEV
import time

# Walk up through nested clusters to find the root GH document (necessary for use in nested clusters)
doc = ghenv.Component.OnPingDocument()
while not doc.FilePath and doc.Owner:
    doc = doc.Owner.OnPingDocument()
ghFileDir = str(Path(doc.FilePath).resolve().parent / "src")

print(f"{ghFileDir=}")

if ghFileDir not in sys.path:
    print("ghFileDir needed to be included")
    sys.path.append(ghFileDir)

import splintcommon
reload(splintcommon) #FOR DEV
from splintcommon import mark_generation_start
mark_generation_start()

#splintcommon module is now available for use in this GhPython component
component_label = ghenv.Component.NickName or ghenv.Component.Name
component_start_time = time.time()
component_run_token = str(int(component_start_time * 1000))
splintcommon.log(f'[{component_label} run={component_run_token}] GhPython Node initialized at {time.ctime(component_start_time)}')


#Component code here
import json
from pprint import pprint

import RelativeMotion
reload(RelativeMotion)
from RelativeMotion import build_exterior_anchor_rings, plan_perimeter_walk, weld_perimeter_walk


raw_data = splintcommon.gh_decode_one(raw_data)
# pprint(raw_data, sort_dicts=True, width=100)
print(type(raw_data), raw_data if not isinstance(raw_data, dict) else "dict OK")


#Phase 5

exterior_anchor_rings, pos_hemis, neg_hemis = build_exterior_anchor_rings(
    raw_data, profile_plane, preserved_intersection_curves)  # radial_band_thickness_mm optional

walk_segments = plan_perimeter_walk(raw_data, pos_hemis, neg_hemis, preserved_intersection_curves)
walk_preview = [s["curve"] for s in walk_segments]

closed_profile, bridge_curves = weld_perimeter_walk(raw_data, walk_segments, profile_plane, exterior_anchor_rings, anchor_bridge_radius_mm, support_bridge_radius_mm)  
# web_fillet_r_mm / min_web_width_mm optional


#END Component code
component_elapsed_seconds = time.time() - component_start_time
splintcommon.log(f'[{component_label} run={component_run_token}] GhPython Node completed in {component_elapsed_seconds:.3f}s')
# ---------- end find_profile_plane_py_4 ----------
preserved_intersection_curves_2 = Curve(find_profile_plane_py_3.preserved_intersection_curves)
full_intersection_curves_2 = Curve(find_profile_plane_py_3.full_intersection_curves)
panel_2 = Panel(factoryautomatorpy_2.out)  # disabled
find_profile_plane_py_5 = Python3Script(
    raw_data=data,
    mcp_points=rotate_supported_fingers_py.mcp_points,
    p1_lines=rotate_supported_fingers_py.p1_lines,
    p1_circles=rotate_supported_fingers_py.p1_circles,
    p1_cylinders=rotate_supported_fingers_py.p1_cylinders,
    profile_plane=find_profile_plane_py.profile_plane,
    support_arc_deg=support_arc_deg_2,
    full_intersection_curves=find_profile_plane_py_3.full_intersection_curves,
    preserved_intersection_curves=find_profile_plane_py_3.preserved_intersection_curves,
    anchor_bridge_radius_mm="3",
    support_bridge_radius_mm="10")  # -> out, exterior_anchor_rings, pos_hemis, neg_hemis, walk_preview, closed_profile, bridge_curves; inputs mcp_points: list of Point3d, p1_lines: list of Line, p1_circles: list of Circle, p1_cylinders: list of Brep, profile_plane: Plane, support_arc_deg: Double, full_intersection_curves: list of Curve, preserved_intersection_curves: list of Curve, anchor_bridge_radius_mm: Double, support_bridge_radius_mm: Double; same code as find_profile_plane_py_4
curve = Curve(find_profile_plane_py_4.neg_hemis)
curve_2 = Curve(find_profile_plane_py_4.closed_profile)
curve_3 = Curve(find_profile_plane_py_4.bridge_curves)
boundary_surfaces = BoundarySurfaces(Edges=find_profile_plane_py_4.closed_profile)
curve_4 = Curve(find_profile_plane_py_5.walk_preview)
merge = Merge(Data1=find_profile_plane_py_4.closed_profile, Data2=find_profile_plane_py_5.closed_profile)  # -> flatten(Result)
boundary_surfaces_2 = BoundarySurfaces(Edges=find_profile_plane_py_5.closed_profile)
loft = Loft(Curves=merge, Options={Adjust=False, Closed=False, LoftEnds=0, LoftSimp=0, LoftType=0, Rebuild=10, Refit=0.01})
merge_2 = Merge(Data1=boundary_surfaces, Data2=loft, Data3=boundary_surfaces_2)  # -> flatten(Result)
brep_join = BrepJoin(Breps=merge_2)  # -> Breps, Closed

# ----
# Local Value Override
# NOTE: Red Canvas Background Indicates that local overrides are in use. File should not be left with local overrides enabled
use_local_values = BooleanToggle(False)  # disabled
right_forward_offset_mm = Number(factoryautomatorpy_2.right_forward_offset_mm)  # disabled
local_warning_py = Python3Script(localOverride=use_local_values)  # -> out; disabled
# ---------- local_warning_py: Python ----------
import Rhino
import Grasshopper
from System.Drawing import Color

# Set the viewport background color
# col = Grasshopper.GUI.Canvas.GH_Skin.canvas_back
# print(f"{col=}")

if localOverride:
    Grasshopper.GUI.Canvas.GH_Skin.canvas_back = Color.FromArgb(255, 255, 0, 0);
else:
    Grasshopper.GUI.Canvas.GH_Skin.canvas_back = Color.FromArgb(255, 212, 208, 200);

# Redraw the view to see the update instantly
Rhino.RhinoDoc.ActiveDoc.Views.Redraw()
# ---------- end local_warning_py ----------
full_perimeter = Number(factoryautomatorpy_2.full_perimeter_mm)  # disabled
boolean_toggle = BooleanToggle(True)  # disabled
band_width_mm = Number(factoryautomatorpy_2.band_width_mm)  # disabled
boolean_toggle_2 = BooleanToggle(True)  # disabled
objectid = Text(factoryautomatorpy_2.objectID)  # disabled
override = Panel("60")  # disabled
c_right = Number()  # disabled
override_2 = Panel("70")  # disabled
override_3 = Panel("100")  # disabled
override_4 = Panel("LOCL")  # disabled
override_5 = Panel("32")  # disabled
c_left = Number()  # disabled
override_6 = Panel("9")  # disabled
b_left_slit = Boolean(factoryautomatorpy_2.b_left_slit)  # disabled
b_right_slit = Boolean(factoryautomatorpy_2.b_right_slit)  # disabled
stream_filter = StreamFilter(Gate=use_local_values, Stream0=c_left, Stream1=override)  # disabled
stream_filter_2 = StreamFilter(Gate=use_local_values, Stream0=c_right, Stream1=override_2)  # disabled
stream_filter_3 = StreamFilter(Gate=use_local_values, Stream0=full_perimeter, Stream1=override_3)  # disabled
stream_filter_4 = StreamFilter(Gate=use_local_values, Stream0=right_forward_offset_mm, Stream1=override_5)  # disabled
stream_filter_5 = StreamFilter(Gate=use_local_values, Stream0=b_left_slit, Stream1=boolean_toggle)  # disabled
stream_filter_6 = StreamFilter(Gate=use_local_values, Stream0=b_right_slit, Stream1=boolean_toggle_2)  # disabled
stream_filter_7 = StreamFilter(Gate=use_local_values, Stream0=band_width_mm, Stream1=override_6)  # disabled
stream_filter_8 = StreamFilter(Gate=use_local_values, Stream0=objectid, Stream1=override_4)  # disabled

axial_band_thickness_mm_4 = Number(axial_band_thickness_mm_3)  # disabled
b_right_slit_2 = Boolean(stream_filter_6)  # disabled
b_left_slit_2 = Boolean(stream_filter_5)  # disabled
solid_difference = SolidDifference(BrepsA=brep_join.Breps, BrepsB=rotate_supported_fingers_py.p1_cylinders)
c_left_mm = Panel(stream_filter)  # disabled
c_right_mm = Panel(stream_filter_2)  # disabled
full_perimeter_mm = Panel(stream_filter_3)  # disabled
right_forward_offset_mm_2 = Panel(stream_filter_4)  # disabled
objectid_2 = Panel(stream_filter_8)  # disabled
panel_3 = Panel(stream_filter_5)  # disabled
panel_4 = Panel(stream_filter_6)  # disabled
panel_5 = Panel(stream_filter_7)  # disabled
unit_x_2 = UnitX(Factor="200")
move_2 = Move(Geometry=solid_difference, Motion=unit_x_2)  # -> Geometry, Transform
root_filename_out = Text(factoryautomatorpy_2.root_filename)  # disabled
output_dir_out = Text(factoryautomatorpy_2.output_dir)  # disabled

# ----
# Finger Circles
min_center_gap_3 = Panel("1.5")  # disabled
c_left_2 = Number(c_left_mm)  # disabled
c_right_2 = Number(c_right_mm)  # disabled
full_perimeter_2 = Number(full_perimeter_mm)  # disabled
axial_band_thickness_mm_5 = Number(axial_band_thickness_mm_3)  # disabled
two_circle_dist_solver_py = Python3Script(c1=c_left_2, c2=c_right_2, full_perimeter=full_perimeter_2, min_center_gap=min_center_gap_3)  # -> out, r1, r2, gap, center_to_center; inputs c1: Double, c2: Double, full_perimeter: Double, min_center_gap: Double; disabled
# ---------- two_circle_dist_solver_py: Python ----------
import math

# Inputs (from GH component)
circumference_1 = c1  # larger circle circumference
circumference_2 = c2  # smaller circle circumference
belt_perimeter = full_perimeter    # convex hull perimeter measurement
is_radius_reversed = False

# Derive radii
r1 = circumference_1 / (2 * math.pi)
r2 = circumference_2 / (2 * math.pi)

# Ensure r1 >= r2
if r2 > r1:
    is_radius_reversed = True
    r1, r2 = r2, r1

def hull_perimeter(d, r1, r2):
    """Convex hull perimeter of two disks with center distance d."""
    tangent_len = 2 * math.sqrt(d**2 - (r1 - r2)**2)
    arc_base = math.pi * (r1 + r2)
    arc_correction = 2 * (r1 - r2) * math.asin((r1 - r2) / d)
    return tangent_len + arc_base + arc_correction

# Bisection solve for center-to-center distance
d_lo = r1 + r2 + 1e-9  # circles just touching
d_hi = belt_perimeter / 2.0
tolerance = 1e-9

for _ in range(200):
    d_mid = (d_lo + d_hi) / 2.0
    if hull_perimeter(d_mid, r1, r2) < belt_perimeter:
        d_lo = d_mid
    else:
        d_hi = d_mid
    if (d_hi - d_lo) < tolerance:
        break

center_distance = (d_lo + d_hi) / 2.0
gap = center_distance - r1 - r2

if (gap < min_center_gap):
    gap = min_center_gap

#Now unreverse the radius if necessary
if is_radius_reversed:
    r1, r2 = r2, r1

center_to_center = r1 + r2 + gap
# ---------- end two_circle_dist_solver_py ----------
addition = Addition(A=two_circle_dist_solver_py.r1, B=axial_band_thickness_mm_5)  # disabled
addition_2 = Addition(A=two_circle_dist_solver_py.r2, B=axial_band_thickness_mm_5)  # disabled
yz_plane = YZPlane(Origin=Point(0, 0, 0))  # disabled
unit_y = UnitY(Factor=expr("-x", two_circle_dist_solver_py.center_to_center))  # disabled
circle_left = Circle(Plane=yz_plane, Radius=addition)  # disabled
circle_left_2 = Circle(Plane=yz_plane, Radius=two_circle_dist_solver_py.r1)  # disabled
circle_right = Circle(Plane=yz_plane, Radius=two_circle_dist_solver_py.r2)  # disabled
circle_right_2 = Circle(Plane=yz_plane, Radius=addition_2)  # disabled
move_3 = Move(Geometry=circle_right, Motion=unit_y)  # -> Geometry, Transform; disabled
transform = Transform(Geometry=circle_right_2, Transform=move_3.Transform)  # disabled
outer_circle_left = Circle(circle_left)  # disabled
outer_circle_right = Circle(transform)  # disabled
circle_right_3 = Circle(move_3.Geometry)  # disabled
circle_left_3 = Circle(circle_left_2)  # disabled
center_to_center_dist = Number(two_circle_dist_solver_py.center_to_center)  # disabled
r_right_outer = Number(addition_2)  # disabled
r_left_outer = Number(addition)  # disabled
r_right = Number(two_circle_dist_solver_py.r2)  # disabled
r_left = Number(two_circle_dist_solver_py.r1)  # disabled

two_circle_dist_solver_py_2 = Python3Script(c1=c_left_2, c2=c_right_2, full_perimeter=full_perimeter_2, min_center_gap=min_center_gap_3)  # -> out, r1, r2, gap, center_to_center; inputs c1: Double, c2: Double, full_perimeter: Double, min_center_gap: Double; disabled
# ---------- two_circle_dist_solver_py_2: Python ----------
# This file represents a stub for a GhPython component in Grasshopper.
# It sets up the environment to import and use the splintcommon or other external modules.

from pathlib import Path
import sys
from importlib import reload #FOR DEV
import time

# Walk up through nested clusters to find the root GH document (necessary for use in nested clusters)
doc = ghenv.Component.OnPingDocument()
while not doc.FilePath and doc.Owner:
    doc = doc.Owner.OnPingDocument()
ghFileDir = str(Path(doc.FilePath).resolve().parent / "src")

print(f"{ghFileDir=}")

if ghFileDir not in sys.path:
    print("ghFileDir needed to be included")
    sys.path.append(ghFileDir)

import splintcommon
reload(splintcommon) #FOR DEV
from splintcommon import mark_generation_start
mark_generation_start()

#splintcommon module is now available for use in this GhPython component
component_label = ghenv.Component.NickName or ghenv.Component.Name
component_start_time = time.time()
component_run_token = str(int(component_start_time * 1000))
splintcommon.log(f'[{component_label} run={component_run_token}] GhPython Node initialized at {time.ctime(component_start_time)}')



import TwoDCirclePositioning
reload(TwoDCirclePositioning)

center_to_center, gap, r1, r2 = TwoDCirclePositioning.two_circle_positioning(c1, c2, full_perimeter, min_center_gap)


component_elapsed_seconds = time.time() - component_start_time
splintcommon.log(f'[{component_label} run={component_run_token}] GhPython Node completed in {component_elapsed_seconds:.3f}s')
# ---------- end two_circle_dist_solver_py_2 ----------
number_slider = Slider(25, range=-50..50)  # disabled
unit_y_2 = UnitY(Factor=number_slider)  # disabled
move_4 = Move(Geometry=outer_circle_right, Motion=unit_y_2)  # -> Geometry, Transform; disabled
minimum_radius = Panel("2.0")  # disabled
min_connecting_bar = Panel("2.5")  # disabled
b_left_slit_3 = Boolean(b_left_slit_2)  # disabled
b_right_slit_3 = Boolean(b_right_slit_2)  # disabled
boolean_toggle_3 = BooleanToggle(True)  # disabled
panel_6 = Panel("-0.2")  # disabled
panel_7 = Panel("0")  # disabled
panel_8 = Panel("1.5")  # disabled
boolean_toggle_4 = BooleanToggle(True)  # disabled
panel_9 = Panel("0.15")  # disabled
panel_10 = Panel("15")  # disabled
annotation_location = Panel("0, -10, -30")  # disabled

# ----
# Initial Geometry
outer_circle_right_2 = Circle(outer_circle_right)  # disabled
outer_circle_left_2 = Circle(outer_circle_left)  # disabled
circle_right_4 = Circle(circle_right_3)  # disabled
circle_left_4 = Circle(circle_left_3)  # disabled
r_right_outer_2 = Number(r_right_outer)  # disabled
r_left_2 = Number(r_left)  # disabled
r_left_outer_2 = Number(r_left_outer)  # disabled
r_right_2 = Number(r_right)  # disabled
merge_3 = Merge(Data1=r_left_2, Data2=r_left_outer_2, Data3=r_right_2, Data4=r_right_outer_2)  # -> flatten(Result); disabled
merge_4 = Merge(Data1=circle_left_4, Data2=outer_circle_left_2, Data3=circle_right_4, Data4=outer_circle_right_2)  # -> flatten(Result); disabled
area = Area(Geometry=merge_4)  # -> Area, Centroid; disabled
deconstruct = Deconstruct(Point=area.Centroid)  # -> XComponent, YComponent, ZComponent; disabled
addition_3 = Addition(A=deconstruct.ZComponent, B=merge_3)  # disabled
construct_point = ConstructPoint(XCoordinate=deconstruct.XComponent, YCoordinate=deconstruct.YComponent, ZCoordinate=addition_3)  # disabled
annotation_dot = AnnotationDot(Location=construct_point, PrimaryText=merge_3)  # -> AnnotationDot, Location, PrimaryText, TextHeight; disabled
annotation_dot_2 = AnnotationDot(annotation_dot.AnnotationDot)  # disabled
circle = Circle(merge_4)  # disabled

panel_11 = Panel("Intersected Solid")  # disabled
panel_12 = Panel("Right Slit")  # disabled
panel_13 = Panel("Left Slit")  # disabled
panel_14 = Panel("Object ID")  # disabled
panel_15 = Panel("Direction Indicator")  # disabled
panel_16 = Panel("Mesh Smoothing")  # disabled
# Bake Me
panel_17 = Panel("Print Bed Orientation")  # disabled
annotation_dot_3 = AnnotationDot(Location=annotation_location, PrimaryText=panel_13)  # -> AnnotationDot, Location, PrimaryText, TextHeight; disabled
annotation_dot_4 = AnnotationDot(Location=annotation_location, PrimaryText=panel_11)  # -> AnnotationDot, Location, PrimaryText, TextHeight; disabled
annotation_dot_5 = AnnotationDot(Location=annotation_location, PrimaryText=panel_12)  # -> AnnotationDot, Location, PrimaryText, TextHeight; disabled
annotation_dot_6 = AnnotationDot(Location=annotation_location, PrimaryText=panel_14)  # -> AnnotationDot, Location, PrimaryText, TextHeight; disabled
annotation_dot_7 = AnnotationDot(Location=annotation_location, PrimaryText=panel_16)  # -> AnnotationDot, Location, PrimaryText, TextHeight; disabled
annotation_dot_8 = AnnotationDot(Location=annotation_location, PrimaryText=panel_15)  # -> AnnotationDot, Location, PrimaryText, TextHeight; disabled
annotation_dot_9 = AnnotationDot(Location=annotation_location, PrimaryText=panel_17)  # -> AnnotationDot, Location, PrimaryText, TextHeight; disabled

# ----
# Create Outer Shell Wall
# Connecting radius coefficient: 0.9 seems to work very well.
# 
# I experimented with both circle closest point distances and circle center distances. Closest point yielded the most predictable results.
outer_circle_right_3 = Circle(outer_circle_right)  # disabled
outer_circle_left_3 = Circle(outer_circle_left)  # disabled
connecting_radius_coefficient = Slider(0.4, range=0.2..3)  # disabled
curve_curve_closest_point = CurveCurveClosestPoint(CurveA=outer_circle_left_3, CurveB=outer_circle_right_3)  # -> PointOnA, ParamOnA, PointOnB, ParamOnB; disabled
distance = Distance(PointA=curve_curve_closest_point.PointOnA, PointB=curve_curve_closest_point.PointOnB)  # disabled
multiplication = Multiplication(A=distance, B=connecting_radius_coefficient)  # disabled

maximum = Maximum(A=multiplication, B=minimum_radius)  # disabled
outer_perimeter_hourglass_py = Python3Script(circle1=outer_circle_left_3, circle2=outer_circle_right_3, hourglass_r=maximum, min_isthmus_width=min_connecting_bar)  # -> out, outer_curve; inputs circle1: Circle, circle2: Circle, hourglass_r: Double, min_isthmus_width: Double; disabled
# ---------- outer_perimeter_hourglass_py: Python ----------
# This file represents a stub for a GhPython component in Grasshopper.
# It sets up the environment to import and use the splintcommon or other external modules.

from pathlib import Path
import sys
from importlib import reload #FOR DEV
import time

# Walk up through nested clusters to find the root GH document (necessary for use in nested clusters)
doc = ghenv.Component.OnPingDocument()
while not doc.FilePath and doc.Owner:
    doc = doc.Owner.OnPingDocument()
ghFileDir = str(Path(doc.FilePath).resolve().parent / "src")

print(f"{ghFileDir=}")

if ghFileDir not in sys.path:
    print("ghFileDir needed to be included")
    sys.path.append(ghFileDir)

import splintcommon
reload(splintcommon) #FOR DEV
from splintcommon import mark_generation_start
mark_generation_start()

#splintcommon module is now available for use in this GhPython component
splintcommon.log(f"GhPython Node initialized at {time.ctime()}")

#Component code here

import TwoDFormHelper
reload(TwoDFormHelper)  # FOR DEV
from TwoDFormHelper import create_two_circle_hourglass_bridge_perimeter

# outer_curve = create_two_circle_hourglass_bridge_perimeter(
#     circle1, circle2, hourglass_r,
#     min_isthmus_width=min_isthmus_width,  # new input
#     tolerance=0.1,
# )

outer_curve = create_two_circle_hourglass_bridge_perimeter(
    circle1, circle2, hourglass_r,
    min_isthmus_width=min_isthmus_width,
    attempt_preserve_hourglass_r=True,
    tolerance=0.1,
    verbose=True
)

splintcommon.log(f"outer_curve type={type(outer_curve)}")
# ---------- end outer_perimeter_hourglass_py ----------

outer_perimeter_hourglass_py_2 = Python3Script(circle1=outer_circle_left_3, circle2=outer_circle_right_3, hourglass_r=maximum)  # -> out, outer_curve; inputs circle1: Circle, circle2: Circle, hourglass_r: Double; disabled
# ---------- outer_perimeter_hourglass_py_2: Python ----------
import Rhino.Geometry as rg
import math


def create_hourglass(circle1, circle2, hourglass_r, tolerance=0.01):
    """Create an hourglass-shaped closed curve joining two non-overlapping circles."""
    c1 = circle1.Center
    c2 = circle2.Center
    r1 = circle1.Radius
    r2 = circle2.Radius

    # Direction from c1 to c2
    axis = c2 - c1
    dist = axis.Length
    axis.Unitize()

    # Perpendicular direction in the circle plane
    normal = circle1.Plane.ZAxis
    perp = rg.Vector3d.CrossProduct(normal, axis)
    perp.Unitize()

    print("C1: r={:.3f}, C2: r={:.3f}, dist={:.3f}, hourglass_r={:.3f}".format(
        r1, r2, dist, hourglass_r))

    # Construction radii (externally tangent)
    R1 = r1 + hourglass_r
    R2 = r2 + hourglass_r

    # Circle-circle intersection: find tangent circle centers
    # x = offset along axis from c1, y = perpendicular offset
    x = (dist * dist + R1 * R1 - R2 * R2) / (2.0 * dist)
    y_sq = R1 * R1 - x * x

    if y_sq < 0:
        print("ERROR: no tangent circles exist (y^2={:.3f}). Adjust hourglass_r.".format(y_sq))
        return None

    y = math.sqrt(y_sq)
    base = c1 + axis * x
    t1_center = base + perp * y
    t2_center = base - perp * y

    print("T1 center: {}, T2 center: {}".format(t1_center, t2_center))

    # 4 tangent points (on original circles, toward tangent circle centers)
    def tangent_pt(circ_center, circ_r, tang_center):
        v = tang_center - circ_center
        v.Unitize()
        return circ_center + v * circ_r

    p_c1_t1 = tangent_pt(c1, r1, t1_center)
    p_c1_t2 = tangent_pt(c1, r1, t2_center)
    p_c2_t1 = tangent_pt(c2, r2, t1_center)
    p_c2_t2 = tangent_pt(c2, r2, t2_center)

    # Interior points for 3-point arc construction
    c1_far = c1 - axis * r1                    # C1 farthest from C2
    c2_far = c2 + axis * r2                    # C2 farthest from C1
    t1_inner = t1_center - perp * hourglass_r  # T1 closest to centerline
    t2_inner = t2_center + perp * hourglass_r  # T2 closest to centerline

    # 4 arcs in continuous path order
    arc_c1 = rg.Arc(p_c1_t2, c1_far, p_c1_t1)   # C1 outer (away from C2)
    arc_t1 = rg.Arc(p_c1_t1, t1_inner, p_c2_t1)  # T1 waist (concave inward)
    arc_c2 = rg.Arc(p_c2_t1, c2_far, p_c2_t2)    # C2 outer (away from C1)
    arc_t2 = rg.Arc(p_c2_t2, t2_inner, p_c1_t2)  # T2 waist (concave inward)

    curves = [
        rg.ArcCurve(arc_c1),
        rg.ArcCurve(arc_t1),
        rg.ArcCurve(arc_c2),
        rg.ArcCurve(arc_t2),
    ]

    print("Arc lengths: C1={:.3f}, T1={:.3f}, C2={:.3f}, T2={:.3f}".format(
        curves[0].GetLength(), curves[1].GetLength(),
        curves[2].GetLength(), curves[3].GetLength()))

    joined = rg.Curve.JoinCurves(curves, tolerance)
    if joined and len(joined) > 0:
        result = joined[0]
        print("Joined: closed={}, length={:.3f}".format(result.IsClosed, result.GetLength()))
        return result
    else:
        print("WARNING: JoinCurves failed, returning individual arcs")
        return curves


# GH component inputs: circle1, circle2, hourglass_r, tolerance
outer_curve = create_hourglass(circle1, circle2, hourglass_r, 0.1)
# ---------- end outer_perimeter_hourglass_py_2 ----------
outer_perimeter_curve = Curve(outer_perimeter_hourglass_py.outer_curve)  # disabled

curve_5 = Curve(outer_perimeter_hourglass_py.outer_curve)  # disabled

# ----
# Solid Blank
initial_circle_left = Circle(circle_left_3)  # disabled
initial_circle_right = Circle(circle_right_3)  # disabled
outer_perimeter_curve_2 = Curve(outer_perimeter_curve)  # disabled
merge_5 = Merge(Data1=outer_perimeter_curve_2, Data2=initial_circle_left, Data3=initial_circle_right)  # -> flatten(Result); disabled
panel_18 = Panel("150")  # disabled
boundary_surfaces_3 = BoundarySurfaces(Edges=merge_5)  # disabled
unit_x_3 = UnitX(Factor=panel_18)  # disabled
extrude = Extrude(Base=boundary_surfaces_3, Direction=unit_x_3)  # disabled
panel_19 = Panel("-0.50")  # disabled
multiplication_2 = Multiplication(A=unit_x_3, B=panel_19)  # disabled
move_5 = Move(Geometry=extrude, Motion=multiplication_2)  # -> Geometry, Transform; disabled
blank_positioned = Brep(move_5.Geometry)  # disabled

# ----
# Front Edge Geometry
outer_perimeter_curve_3 = Curve(outer_perimeter_curve)  # disabled
initial_circle_left_2 = Circle(circle_left_3)  # disabled
initial_circle_right_2 = Circle(circle_right_3)  # disabled
right_forward_offset_mm_3 = Number(right_forward_offset_mm_2)  # disabled
merge_6 = Merge(Data1=outer_perimeter_curve_3, Data2=initial_circle_left_2, Data3=initial_circle_right_2)  # -> flatten(Result); disabled
panel_20 = Panel("50")  # disabled
boundary_surfaces_4 = BoundarySurfaces(Edges=merge_6)  # disabled
unit_x_4 = UnitX(Factor=panel_20)  # disabled
unit_x_5 = UnitX(Factor=right_forward_offset_mm_3)  # disabled
panel_21 = Panel("-0.50")  # disabled
move_6 = Move(Geometry=initial_circle_right_2, Motion=unit_x_5)  # -> Geometry, Transform; disabled
transform_2 = Transform(Geometry=outer_perimeter_curve_3, Transform=move_6.Transform)  # disabled
multiplication_3 = Multiplication(A=unit_x_4, B=panel_21)  # disabled
front_outer_perimeter_positioned_right = Curve(transform_2)  # disabled
front_outer_perimeter_positioned_left = Curve(outer_perimeter_curve_3)  # disabled
front_circle_left_positioned = Circle(initial_circle_left_2)  # disabled
front_circle_right_positioned = Circle(move_6.Geometry)  # disabled

# ----
# Back Edge Geometry
minimum_band_width_mm = Number(stream_filter_7)  # disabled
circle_left_positioned = Circle(front_circle_left_positioned)  # disabled
outer_perimeter_positioned_left = Curve(front_outer_perimeter_positioned_left)  # disabled
circle_right_positioned = Circle(front_circle_right_positioned)  # disabled
outer_perimeter_positioned_right = Curve(front_outer_perimeter_positioned_right)  # disabled
unit_x_6 = UnitX(Factor=minimum_band_width_mm)  # disabled
move_7 = Move(Geometry=circle_left_positioned, Motion=unit_x_6)  # -> Geometry, Transform; disabled
transform_3 = Transform(Geometry=circle_right_positioned, Transform=move_7.Transform)  # disabled
transform_4 = Transform(Geometry=outer_perimeter_positioned_right, Transform=move_7.Transform)  # disabled
transform_5 = Transform(Geometry=outer_perimeter_positioned_left, Transform=move_7.Transform)  # disabled
back_outer_perimeter_positioned_right = Curve(transform_4)  # disabled
back_outer_perimeter_positioned_left = Curve(transform_5)  # disabled
back_circle_right_positioned = Circle(transform_3)  # disabled
back_circle_left_positioned = Circle(move_7.Geometry)  # disabled

blank_positioned_2 = Brep(blank_positioned)  # disabled

# ----
# Solid Intersection Template
blank_positioned_3 = Brep(blank_positioned)  # disabled
front_outer_perimeter_positioned_left_2 = Curve(front_outer_perimeter_positioned_left)  # disabled
front_perimeter_positioned_right = Curve(front_outer_perimeter_positioned_right)  # disabled
back_outer_perimeter_positioned_right_2 = Curve(back_outer_perimeter_positioned_right)  # disabled
back_outer_perimeter_positioned_left_2 = Curve(back_outer_perimeter_positioned_left)  # disabled
far_left_back = Panel("-1000, 1000, 0")  # disabled
far_left_forward = Panel("1000, 1000, 0")  # disabled
far_right_forward = Panel("1000, -1000, 0")  # disabled
far_right_backward = Panel("-1000, -1000, 0")  # disabled
point = Point(far_left_forward)  # disabled
point_2 = Point(far_left_back)  # disabled
point_3 = Point(far_right_forward)  # disabled
point_4 = Point(far_right_backward)  # disabled
curve_closest_point = CurveClosestPoint(Point=point_2, Curve=front_outer_perimeter_positioned_left_2)  # -> Point, Parameter, Distance; disabled
curve_closest_point_2 = CurveClosestPoint(Point=point_3, Curve=back_outer_perimeter_positioned_right_2)  # -> Point, Parameter, Distance; disabled
curve_closest_point_3 = CurveClosestPoint(Point=point_4, Curve=front_perimeter_positioned_right)  # -> Point, Parameter, Distance; disabled
curve_closest_point_4 = CurveClosestPoint(Point=point, Curve=back_outer_perimeter_positioned_left_2)  # -> Point, Parameter, Distance; disabled
merge_7 = Merge(
    Data1=curve_closest_point_4.Point,
    Data2=curve_closest_point_2.Point,
    Data3=curve_closest_point_3.Point,
    Data4=curve_closest_point.Point)  # -> flatten(Result); disabled
panel_22 = Panel("-100")  # disabled
polyline = PolyLine(Vertices=merge_7, Closed=True)  # disabled
unit_z = UnitZ(Factor=panel_22)  # disabled
boundary_surfaces_5 = BoundarySurfaces(Edges=polyline)  # disabled
reverse = Reverse(Vector=unit_z)  # disabled
move_8 = Move(Geometry=boundary_surfaces_5, Motion=unit_z)  # -> Geometry, Transform; disabled
panel_23 = Panel("2")  # disabled
multiplication_4 = Multiplication(A=reverse, B=panel_23)  # disabled
extrude_2 = Extrude(Base=move_8.Geometry, Direction=multiplication_4)  # disabled
blank_positioned_4 = Brep(blank_positioned_3)  # disabled
solid_intersection = SolidIntersection(BrepsA=extrude_2, BrepsB=blank_positioned_4)  # disabled
panel_24 = Panel("0.1")  # disabled
later_fillet_edges_py = Python3Script(fillet_brep=solid_intersection, fillet_r=panel_24, x=boolean_toggle_3)  # -> out, output_brep, flatten(sharp_edges); inputs fillet_brep: Brep, fillet_r: Double; disabled
# ---------- later_fillet_edges_py: Python ----------
# This file represents a stub for a GhPython component in Grasshopper.
# It sets up the environment to import and use the splintcommon or other external modules.

from pathlib import Path
import sys
from importlib import reload #FOR DEV
import time

# Walk up through nested clusters to find the root GH document (necessary for use in nested clusters)
doc = ghenv.Component.OnPingDocument()
while not doc.FilePath and doc.Owner:
    doc = doc.Owner.OnPingDocument()
ghFileDir = str(Path(doc.FilePath).resolve().parent / "src")

print(f"{ghFileDir=}")

if ghFileDir not in sys.path:
    print("ghFileDir needed to be included")
    sys.path.append(ghFileDir)

import splintcommon
reload(splintcommon) #FOR DEV
from splintcommon import mark_generation_start
mark_generation_start()

#splintcommon module is now available for use in this GhPython component
splintcommon.log(f'Gh FilletSharpEdges Node initialized at {time.ctime()}')

#Component code here

import BrepFillet
reload(BrepFillet)
from BrepFillet import fillet_sharp_edges, find_sharp_edges

# fillet_r = 0.1
min_angle_degrees = 60.0 # 60.0
#output_brep = fillet_sharp_edges(fillet_brep, fillet_r, min_angle_degrees, 0.1)

sharp_edges, sharp_angles = find_sharp_edges(fillet_brep, min_angle_degrees)

print(f"{type(sharp_edges)}")
print(f"{sharp_edges=}")
# ---------- end later_fillet_edges_py ----------
panel_25 = Panel(later_fillet_edges_py.out)  # disabled
horizontal_outline_surface = Geometry(boundary_surfaces_5)  # disabled
horizontal_outline = Geometry(polyline)  # disabled
horizontal_cutter = Brep(extrude_2)  # disabled
splint_brep = Brep(solid_intersection)  # disabled

# ----
# Geometry Analysis
unit_z_2 = UnitZ(Factor=1)  # disabled
slit_nudge_z = Panel("0.0")  # disabled
target_brep = Brep(splint_brep)  # disabled
unit_z_3 = UnitZ(Factor=slit_nudge_z)  # disabled
box_center_slice_py = Python3Script(target_brep=target_brep, view_vector=unit_z_2)  # -> out, slice_surface, y_size; inputs target_brep: Brep, view_vector: Vector3d; disabled
# ---------- box_center_slice_py: Python ----------
# This file represents a stub for a GhPython component in Grasshopper.
# It sets up the environment to import and use the splintcommon or other external modules.

from pathlib import Path
import sys
from importlib import reload #FOR DEV
import time

# In normal GH doc
ghFileDir = None
try:
    ghFileDir = str(Path.joinpath(Path(ghenv.Component.OnPingDocument().FilePath).resolve().parents[0], "src"))
except:
    # In GH Cluster
    ghFileDir = str(Path.joinpath(Path(ghenv.Component.OnPingDocument().Owner.OnPingDocument().FilePath).resolve().parents[0], "src"))

print(f"{ghFileDir=}")

if ghFileDir not in sys.path:
    print("ghFileDir needed to be included")
    sys.path.append(ghFileDir)

import splintcommon
reload(splintcommon) #FOR DEV

#splintcommon module is now available for use in this GhPython component
splintcommon.log(f'GhPython Node initialized at {time.ctime()}')

import FeatureIdentification
reload(FeatureIdentification) #FOR DEV
from FeatureIdentification import box_center_slice

import Rhino.Geometry as rg

# Get a slice plane at the center, facing +Y direction
slice_surface, sizes = box_center_slice(
    target_brep=target_brep,
    bbox_plane=rg.Plane.WorldXY,
    choose_side_vector=view_vector,
    return_size=True,
)

print(f"{sizes=}")

y_size = sizes[1]

print(f"{y_size=}")
# ---------- end box_center_slice_py ----------
move_9 = Move(Geometry=box_center_slice_py.slice_surface, Motion=unit_z_3)  # -> Geometry, Transform; disabled
brep_brep = BrepBrep(BrepA=target_brep, BrepB=move_9.Geometry)  # -> Curves, Points; disabled
area_2 = Area(Geometry=brep_brep.Curves)  # -> Area, Centroid; disabled
deconstruct_2 = Deconstruct(Point=area_2.Centroid)  # -> XComponent, YComponent, ZComponent; disabled
sort_list = SortList(Keys=deconstruct_2.YComponent, ValuesValuesA=brep_brep.Curves)  # -> Keys, ValuesValuesA; disabled
left_index = Panel("2")  # disabled
middle_index = Panel("1")  # disabled
right_index = Panel("0")  # disabled
list_item = ListItem(List=sort_list.ValuesValuesA, Index=left_index, Wrap=True)  # disabled
list_item_2 = ListItem(List=sort_list.ValuesValuesA, Index=middle_index, Wrap=True)  # disabled
list_item_3 = ListItem(List=sort_list.ValuesValuesA, Index=right_index, Wrap=True)  # disabled
middle_support_curve = Curve(list_item_2)  # disabled
left_ring_extreme = Curve(list_item)  # disabled
right_wall_curve = Curve(list_item_3)  # disabled
ring_hole_analysis = RingHoleAnalysis(left_curve=list_item, right_curve=list_item_2)  # -> center_pt_2, back_left_pt_2, front_left_pt_2, back_right_pt_2, front_right_pt_2; disabled
ring_hole_analysis_2 = RingHoleAnalysis(left_curve=middle_support_curve, right_curve=right_wall_curve)  # -> center_pt_2, back_left_pt_2, front_left_pt_2, back_right_pt_2, front_right_pt_2; disabled
middle_support_curve_2 = Curve(middle_support_curve)  # disabled
right_hole_center = Point(ring_hole_analysis_2.center_pt_2)  # disabled
left_hole_center = Point(ring_hole_analysis.center_pt_2)  # disabled
right_wall_curve_2 = Curve(right_wall_curve)  # disabled
left_wall_curve = Curve(left_ring_extreme)  # disabled

print_bed_laydown_line = Line(StartPoint=curve_closest_point.Point, EndPoint=curve_closest_point_3.Point)  # disabled
horizontal_cutter_2 = Brep(extrude_2)  # disabled
edge_curves = EdgeCurves(sharp_edge_indexes=later_fillet_edges_py.sharp_edges, brep=solid_intersection)  # disabled

print_bed_laydown_line_2 = Line(print_bed_laydown_line)  # disabled
main_body_sharp_edges = Curve(edge_curves)  # disabled

# ----
# Probe Construction
right_hole_center_2 = Point(right_hole_center)  # disabled
left_hole_center_2 = Point(left_hole_center)  # disabled
average = Average(Input=[left_hole_center_2, right_hole_center_2])  # disabled
deconstruct_3 = Deconstruct(Point=average)  # -> XComponent, YComponent, ZComponent; disabled
deconstruct_4 = Deconstruct(Point=right_hole_center_2)  # -> XComponent, YComponent, ZComponent; disabled
deconstruct_5 = Deconstruct(Point=left_hole_center_2)  # -> XComponent, YComponent, ZComponent; disabled
construct_point_2 = ConstructPoint(XCoordinate=deconstruct_3.XComponent, YCoordinate=deconstruct_4.YComponent, ZCoordinate=deconstruct_4.ZComponent)  # disabled
construct_point_3 = ConstructPoint(XCoordinate=deconstruct_3.XComponent, YCoordinate=deconstruct_5.YComponent, ZCoordinate=deconstruct_5.ZComponent)  # disabled
unit_z_4 = UnitZ(Factor=1)  # disabled
panel_26 = Panel("30")  # disabled
line = Line(StartPoint=construct_point_3, EndPoint=construct_point_2)  # disabled
line_sdl = LineSDL(Start=right_hole_center_2, Direction=unit_z_4, Length=panel_26)  # disabled
line_sdl_2 = LineSDL(Start=left_hole_center_2, Direction=unit_z_4, Length=panel_26)  # disabled
middle_wall_probe_line = Line(line)  # disabled
left_probe_line = Line(line_sdl_2)  # disabled
right_probe_line = Line(line_sdl)  # disabled

# ----
# Solid Construction Geometry
front_circle_left_positioned_2 = Circle(front_circle_left_positioned)  # disabled
front_outer_perimeter_positioned_left_3 = Curve(front_outer_perimeter_positioned_left)  # disabled
front_circle_right_positioned_2 = Circle(front_circle_right_positioned)  # disabled
front_outer_perimeter_positioned_right_2 = Curve(front_outer_perimeter_positioned_right)  # disabled
back_outer_perimeter_positioned_left_3 = Curve(back_outer_perimeter_positioned_left)  # disabled
back_circle_right_positioned_2 = Circle(back_circle_right_positioned)  # disabled
back_outer_perimeter_positioned_right_3 = Curve(back_outer_perimeter_positioned_right)  # disabled
back_circle_left_positioned_2 = Circle(back_circle_left_positioned)  # disabled
horizontal_outline_surface_2 = Geometry(horizontal_outline_surface)  # disabled
horizontal_outline_2 = Geometry(horizontal_outline)  # disabled
merge_8 = Merge(
    Data1=front_circle_left_positioned_2,
    Data2=front_outer_perimeter_positioned_left_3,
    Data3=front_circle_right_positioned_2,
    Data4=front_outer_perimeter_positioned_right_2)  # -> flatten(Result); disabled
merge_9 = Merge(
    Data1=back_circle_left_positioned_2,
    Data2=back_outer_perimeter_positioned_left_3,
    Data3=back_circle_right_positioned_2,
    Data4=back_outer_perimeter_positioned_right_3)  # -> flatten(Result); disabled
merge_10 = Merge(Data1=horizontal_outline_2, Data2=horizontal_outline_surface_2)  # -> flatten(Result); disabled
horizontal_geometry = Geometry(merge_10)  # disabled
back_geometry = Geometry(merge_9)  # disabled
front_geometry = Geometry(merge_8)  # disabled

horizontal_cutter_3 = Brep(horizontal_cutter)  # disabled
splint_brep_2 = Brep(splint_brep)  # disabled
print_bed_laydown_line_3 = Line(print_bed_laydown_line_2)  # disabled

# ----
# Left Slit
b_left_slit_4 = Boolean(b_left_slit_3)  # disabled
splint_brep_3 = Brep(splint_brep)  # disabled
left_wall_curve_2 = Curve(left_wall_curve)  # disabled
slit_thickness = Panel("0.3")  # disabled
shortcircuit_slit_py = Python3Script(is_slit_active=b_left_slit_4, splint_brep=splint_brep_3)  # -> out, brep_to_slit, brep_to_shortcircuit; inputs is_slit_active: Boolean, splint_brep: Brep; disabled
# ---------- shortcircuit_slit_py: Python ----------
if is_slit_active:
    brep_to_slit = splint_brep
    brep_to_shortcircuit = None
else:
    brep_to_slit = None
    brep_to_shortcircuit = splint_brep
# ---------- end shortcircuit_slit_py ----------
boundary_surfaces_6 = BoundarySurfaces(Edges=left_wall_curve_2)  # disabled
area_3 = Area(Geometry=boundary_surfaces_6)  # -> Area, Centroid; disabled
panel_27 = Panel("1.25")  # disabled
scale = Scale(Geometry=boundary_surfaces_6, Center=area_3.Centroid, Factor=panel_27)  # -> Geometry, Transform; disabled
slitbot_py = Python3Script(splint_brep=shortcircuit_slit_py.brep_to_slit, slit_panel=scale.Geometry, slit_thickness=slit_thickness)  # -> out, brep_out, flatten(side_a_edges), flatten(side_b_edges), side_a_cutter, side_b_cutter; inputs splint_brep: Brep, slit_panel: Brep, slit_thickness: Double; disabled
# ---------- slitbot_py: Python ----------
# This file represents a stub for a GhPython component in Grasshopper.
# It sets up the environment to import and use the splintcommon or other external modules.

from pathlib import Path
import sys
from importlib import reload #FOR DEV
import time

# Walk up through nested clusters to find the root GH document (necessary for use in nested clusters)
doc = ghenv.Component.OnPingDocument()
while not doc.FilePath and doc.Owner:
    doc = doc.Owner.OnPingDocument()
ghFileDir = str(Path(doc.FilePath).resolve().parent / "src")

print(f"{ghFileDir=}")

if ghFileDir not in sys.path:
    print("ghFileDir needed to be included")
    sys.path.append(ghFileDir)

import splintcommon
reload(splintcommon) #FOR DEV
from splintcommon import mark_generation_start
mark_generation_start()

#splintcommon module is now available for use in this GhPython component
splintcommon.log(f'GhPython Node initialized at {time.ctime()}')

#Component code here

import BrepSlit
reload(BrepSlit)
from BrepSlit import cut_slit

fillet_radius = 0.3

brep_out, side_a_edges, side_b_edges, side_a_cutter, side_b_cutter = cut_slit(splint_brep, slit_panel, slit_thickness, fillet_radius)

print(f"{side_a_edges=}")
print(f"{side_b_edges=}")
# ---------- end slitbot_py ----------
brep = Brep(slitbot_py.side_a_cutter)  # disabled
brep_2 = Brep(slitbot_py.side_b_cutter)  # disabled
shortcircuit_slit_py_2 = Python3Script(is_slit_active=b_left_slit_4, slit_brep=slitbot_py.brep_out, splint_brep=shortcircuit_slit_py.brep_to_shortcircuit)  # -> out, out_brep; inputs is_slit_active: Boolean, slit_brep: Brep, splint_brep: Brep; disabled
# ---------- shortcircuit_slit_py_2: Python ----------
print(f"{is_slit_active=}")
if is_slit_active:
    print("Returning the slit brep")
    out_brep = slit_brep
else:
    print("Returning the boring splint")
    out_brep = splint_brep
# ---------- end shortcircuit_slit_py_2 ----------
splint_brep_left_slit = Brep(shortcircuit_slit_py_2.out_brep)  # disabled

# ----
# Right Slit
right_wall_curve_3 = Curve(right_wall_curve_2)  # disabled
splint_brep_4 = Brep(splint_brep_left_slit)  # disabled
shortcircuit_slit_py_3 = Python3Script(is_slit_active=b_right_slit_3, splint_brep=splint_brep_4)  # -> out, brep_to_slit, brep_to_shortcircuit; inputs is_slit_active: Boolean, splint_brep: Brep; disabled; same code as shortcircuit_slit_py
boundary_surfaces_7 = BoundarySurfaces(Edges=right_wall_curve_3)  # disabled
area_4 = Area(Geometry=boundary_surfaces_7)  # -> Area, Centroid; disabled
panel_28 = Panel("1.25")  # disabled
scale_2 = Scale(Geometry=boundary_surfaces_7, Center=area_4.Centroid, Factor=panel_28)  # -> Geometry, Transform; disabled
slitbot_py_2 = Python3Script(splint_brep=shortcircuit_slit_py_3.brep_to_slit, slit_panel=scale_2.Geometry, slit_thickness=slit_thickness)  # -> out, brep_out, flatten(side_a_edges), flatten(side_b_edges), side_a_cutter, side_b_cutter; inputs splint_brep: Brep, slit_panel: Brep, slit_thickness: Double; disabled; same code as slitbot_py
merge_11 = Merge(Data1=slitbot_py_2.side_a_edges, Data2=slitbot_py_2.side_b_edges)  # -> flatten(Result); disabled
edge_curves_2 = EdgeCurves(sharp_edge_indexes=merge_11, brep=slitbot_py_2.brep_out)  # disabled
brep_3 = Brep(slitbot_py_2.side_a_cutter)  # disabled
brep_4 = Brep(slitbot_py_2.side_b_cutter)  # disabled
shortcircuit_slit_py_4 = Python3Script(is_slit_active=b_right_slit_3, slit_brep=slitbot_py_2.brep_out, splint_brep=shortcircuit_slit_py_3.brep_to_shortcircuit)  # -> out, out_brep; inputs is_slit_active: Boolean, slit_brep: Brep, splint_brep: Brep; disabled; same code as shortcircuit_slit_py_2
right_slit_sharp_edges = Curve(edge_curves_2)  # disabled
splint_brep_right_slit = Brep(shortcircuit_slit_py_4.out_brep)  # disabled

merge_12 = Merge(Data1=slitbot_py.side_a_edges, Data2=slitbot_py.side_b_edges)  # -> flatten(Result); disabled

edge_curves_3 = EdgeCurves(sharp_edge_indexes=merge_12, brep=slitbot_py.brep_out)  # disabled
left_slit_sharp_edges = Curve(edge_curves_3)  # disabled

panel_29 = Panel(slitbot_py_2.out)  # disabled
panel_30 = Panel(slitbot_py.out)  # disabled
splint_brep_right_slit_2 = Brep(splint_brep_right_slit)  # disabled
splint_brep_left_slit_2 = Brep(splint_brep_left_slit)  # disabled
merge_13 = Merge(Data1=splint_brep_left_slit_2, Data2=annotation_dot_3.AnnotationDot)  # -> flatten(Result); disabled
merge_14 = Merge(Data1=splint_brep_right_slit_2, Data2=annotation_dot_5.AnnotationDot)  # -> flatten(Result); disabled

# ----
# Laydown Line Perp Calcs
print_bed_laydown_line_4 = Line(print_bed_laydown_line_2)  # disabled
panel_31 = Panel("0.3")  # disabled
perp_frame = PerpFrame(Curve=print_bed_laydown_line_4, Parameter=panel_31)  # disabled
panel_32 = Panel("0, -100, 0")  # disabled
panel_33 = Panel("50")  # disabled
line_sdl_3 = LineSDL(Start=perp_frame, Direction=panel_32, Length=panel_33)  # disabled
xy_plane = XYPlane(Origin=Point(0, 0, 0))  # disabled
deconstruct_plane = DeconstructPlane(Plane=perp_frame)  # -> Origin, XAxis, YAxis, ZAxis; disabled
orient = Orient(Geometry=line_sdl_3, Source=xy_plane, Target=perp_frame)  # -> Geometry, Transform; disabled
unit_vector = UnitVector(Vector=print_bed_laydown_line_4)  # disabled
panel_34 = Panel("Xw")  # disabled
reverse_2 = Reverse(Vector=unit_vector)  # disabled
unit_vector_2 = UnitVector(Vector=orient.Geometry)  # disabled
construct_plane = ConstructPlane(Origin=deconstruct_plane.Origin, XAxis=unit_vector_2, YAxis=reverse_2)  # disabled
vizplane = VizPlane(plane=construct_plane)  # -> tip_2, line_2, annotation_dot_2; disabled
tip = Brep(vizplane.tip_2)  # disabled
line_2 = Line(vizplane.line_2)  # disabled
annotation_dot_10 = AnnotationDot(vizplane.annotation_dot_2)  # disabled
laydown_line_perp_dir = Vector(unit_vector_2)  # disabled
laydown_plane = Plane(construct_plane)  # disabled

# ----
# ID Embossing Gun
finishedsplintbrep = Brep(splint_brep_right_slit)  # disabled
text_size = Slider(3.3, range=2.5..6)  # disabled
laydown_line_perp_dir_2 = Vector(laydown_line_perp_dir)  # disabled
objectid_3 = Text(objectid_2)  # disabled
left_hole_center_3 = Point(left_hole_center)  # disabled
axial_band_thickness_mm_6 = Number(axial_band_thickness_mm_4)  # disabled
panel_35 = Panel(objectid_3)  # disabled
panel_36 = Panel("-1")  # disabled
boolean_toggle_5 = BooleanToggle(False)  # disabled
unit_z_5 = UnitZ(Factor=panel_36)  # disabled
panel_37 = Panel("0.29")  # disabled
panel_38 = Panel("4")  # disabled
panel_39 = Panel("proj")  # disabled
panel_40 = Panel("up")  # disabled
textgun_py = Python3Script(
    splint_brep=finishedsplintbrep,
    object_id=objectid_3,
    text_up_vector=laydown_line_perp_dir_2,
    wall_thickness_mm=axial_band_thickness_mm_6,
    text_size=text_size,
    text_projection_vector=unit_z_5,
    extrusion_depth_factor=panel_37,
    projection_origin=left_hole_center_3,
    x=boolean_toggle_5)  # -> out, embossedBrep, originalTextBreps, final_text_plane, projected_letters; inputs splint_brep: Brep, object_id: String, text_up_vector: Vector3d, text_size: Double, text_projection_vector: Vector3d, extrusion_depth_factor: Double, projection_origin: Point3d; disabled
# ---------- textgun_py: Python ----------
# This file represents a stub for a GhPython component in Grasshopper.
# It sets up the environment to import and use the splintcommon or other external modules.

from pathlib import Path
import sys
from importlib import reload #FOR DEV ONLY
import time

# In normal GH doc
ghFileDir = None
try:
    ghFileDir = str(Path.joinpath(Path(ghenv.Component.OnPingDocument().FilePath).resolve().parents[0], "src"))
except:
    # In GH Cluster
    ghFileDir = str(Path.joinpath(Path(ghenv.Component.OnPingDocument().Owner.OnPingDocument().FilePath).resolve().parents[0], "src"))

print(f"{ghFileDir=}")

if ghFileDir not in sys.path:
    print("ghFileDir needed to be included")
    sys.path.append(ghFileDir)

import splintcommon
reload(splintcommon) #FOR DEV

#splintcommon module is now available for use in this GhPython component
splintcommon.log(f'GhPython Node initialized at {time.ctime()}')

import TextGun
reload(TextGun) #FOR DEV
from TextGun import emboss_text

embossedBrep, originalTextBreps, projected_letters, final_text_plane = emboss_text(
    target_brep=splint_brep,
    text_content=object_id,
    wall_thickness_mm=wall_thickness_mm,
    text_size=text_size,
    text_up_vector=text_up_vector,
    text_projection_vector=text_projection_vector,
    extrusion_depth_factor=extrusion_depth_factor,
    projection_origin=projection_origin,
    emboss_inside=True,
    align_to_surface_normal=True
)
# ---------- end textgun_py ----------
plane = Plane(textgun_py.final_text_plane)  # disabled
vizplane_2 = VizPlane(plane=plane)  # -> tip_2, line_2, annotation_dot_2; disabled
vizvector = Arrow(direction=Vector(0, 0, 1), arrowlen=panel_38, text=panel_40)  # -> cone_2, line, annotation_dot_2; disabled
vizvector_2 = Arrow(direction=Vector(0, 0, 1), arrowlen=panel_38, text=panel_39)  # -> cone_2, line, annotation_dot_2; disabled
tip_2 = Brep(vizvector.cone_2)  # disabled
line_3 = Line(vizvector.line)  # disabled
annotation_dot_11 = AnnotationDot(vizvector.annotation_dot_2)  # disabled
tip_3 = Brep(vizplane_2.tip_2)  # disabled
line_4 = Line(vizplane_2.line_2)  # disabled
annotation_dot_12 = AnnotationDot(vizplane_2.annotation_dot_2)  # disabled
panel_41 = Panel(textgun_py.out)  # disabled
brep_5 = Brep(textgun_py.originalTextBreps)  # disabled
plane_2 = Plane(textgun_py.final_text_plane)  # disabled
projected_letters_brep = Brep(graft(textgun_py.projected_letters))  # disabled
panel_42 = Panel(projected_letters_brep)  # disabled
splint_with_embossed_id = Brep(textgun_py.embossedBrep)  # disabled

vizvector_3 = Arrow(start=deconstruct_plane.Origin, direction=unit_vector_2, arrowlen=panel_38, text=panel_34)  # -> cone_2, line, annotation_dot_2; disabled

splint_with_embossed_id_2 = Brep(splint_with_embossed_id)  # disabled
projected_letters_brep_2 = Brep(graft(projected_letters_brep))  # disabled

# ----
# Direction Indicator
# Find center pillar xy position
# Find center pillar yz position
ball_r_to_wall_ratio = Slider(0.68, range=0.6..1)  # disabled
splint_body = Brep(splint_with_embossed_id)  # disabled
middle_support_curve_3 = Curve(middle_support_curve_2)  # disabled
axial_band_thickness_mm_7 = Number(axial_band_thickness_mm_4)  # disabled
unit_y_3 = UnitY(Factor=1)  # disabled
multiplication_5 = Multiplication(A=axial_band_thickness_mm_7, B=ball_r_to_wall_ratio)  # disabled
area_5 = Area(Geometry=middle_support_curve_3)  # -> Area, Centroid; disabled
box_center_slice_py_2 = Python3Script(target_brep=splint_body, view_vector=unit_y_3)  # -> out, slice_surface, y_shift; inputs target_brep: Brep, view_vector: Vector3d; disabled
# ---------- box_center_slice_py_2: Python ----------
# This file represents a stub for a GhPython component in Grasshopper.
# It sets up the environment to import and use the splintcommon or other external modules.

from pathlib import Path
import sys
from importlib import reload #FOR DEV
import time

# In normal GH doc
ghFileDir = None
try:
    ghFileDir = str(Path.joinpath(Path(ghenv.Component.OnPingDocument().FilePath).resolve().parents[0], "src"))
except:
    # In GH Cluster
    ghFileDir = str(Path.joinpath(Path(ghenv.Component.OnPingDocument().Owner.OnPingDocument().FilePath).resolve().parents[0], "src"))

print(f"{ghFileDir=}")

if ghFileDir not in sys.path:
    print("ghFileDir needed to be included")
    sys.path.append(ghFileDir)

import splintcommon
reload(splintcommon) #FOR DEV

#splintcommon module is now available for use in this GhPython component
splintcommon.log(f'GhPython Node initialized at {time.ctime()}')

import FeatureIdentification
reload(FeatureIdentification) #FOR DEV
from FeatureIdentification import box_center_slice

import Rhino.Geometry as rg

# Get a slice plane at the center, facing +Y direction
slice_surface, sizes = box_center_slice(
    target_brep=target_brep,
    bbox_plane=rg.Plane.WorldXY,
    choose_side_vector=view_vector,
    return_size=True,
)

print(f"{sizes=}")

y_shift = sizes[1] * .6

print(f"{y_shift=}")
# ---------- end box_center_slice_py_2 ----------
area_6 = Area(Geometry=box_center_slice_py_2.slice_surface)  # -> Area, Centroid; disabled
panel_43 = Panel("-100")  # disabled
nub_radius = Panel(multiplication_5)  # disabled
central_post_centroid = Point(area_5.Centroid)  # disabled
central_post_centroid_2 = Point(central_post_centroid)  # disabled
deconstruct_6 = Deconstruct(Point=central_post_centroid_2)  # -> XComponent, YComponent, ZComponent; disabled
unit_z_6 = UnitZ(Factor=panel_43)  # disabled
deconstruct_7 = Deconstruct(Point=area_6.Centroid)  # -> XComponent, YComponent, ZComponent; disabled
move_10 = Move(Geometry=central_post_centroid, Motion=unit_z_6)  # -> Geometry, Transform; disabled
construct_point_4 = ConstructPoint(XCoordinate=deconstruct_7.XComponent, YCoordinate=deconstruct_6.YComponent, ZCoordinate=deconstruct_7.ZComponent)  # disabled
move_to_point = MoveToPoint(Geometry=box_center_slice_py_2.slice_surface, PointA=area_6.Centroid, PointB=construct_point_4)  # -> Moved, Vector, Transform; disabled
brep_brep_2 = BrepBrep(BrepA=splint_body, BrepB=move_to_point.Moved)  # -> Curves, Points; disabled
panel_44 = Panel("0")  # disabled
list_item_4 = ListItem(List=brep_brep_2.Curves, Index=panel_44, Wrap=True)  # disabled
central_post_cross_section = Curve(list_item_4)  # disabled
curve_closest_point_5 = CurveClosestPoint(Point=move_10.Geometry, Curve=central_post_cross_section)  # -> Point, Parameter, Distance; disabled
deconstruct_8 = Deconstruct(Point=curve_closest_point_5.Point)  # -> XComponent, YComponent, ZComponent; disabled
panel_45 = Panel("100")  # disabled
negative = Negative(Value=panel_45)  # disabled
construct_point_5 = ConstructPoint(XCoordinate=panel_45, YCoordinate=deconstruct_8.YComponent, ZCoordinate=negative)  # disabled
curve_closest_point_6 = CurveClosestPoint(Point=construct_point_5, Curve=central_post_cross_section)  # -> Point, Parameter, Distance; disabled
line_5 = Line(StartPoint=curve_closest_point_5.Point, EndPoint=curve_closest_point_6.Point)  # disabled
point_on_curve = PointOnCurve(line_5, parameter=0.5)  # disabled
point_5 = Point(point_on_curve)  # disabled
xy_plane_2 = XYPlane(Origin=point_5)  # disabled
sphere = Sphere(Base=xy_plane_2, Radius=nub_radius)  # disabled
splint_body_2 = Brep(splint_body)  # disabled
direction_sphere = Geometry(sphere)  # disabled

multiplication_6 = Multiplication(A=nub_radius, B=panel_6)  # disabled
unit_z_7 = UnitZ(Factor=multiplication_6)  # disabled
move_11 = Move(Geometry=sphere, Motion=unit_z_7)  # -> Geometry, Transform; disabled

solid_difference_2 = SolidDifference(BrepsA=splint_body_2, BrepsB=move_11.Geometry)  # disabled
splints_w_direction_indicator = Brep(solid_difference_2)  # disabled

splints_w_direction_indicator_2 = Brep(splints_w_direction_indicator)  # disabled
direction_sphere_2 = Geometry(direction_sphere)  # disabled

# ----
# Final Meshing
# And Smoothing
splint_form = Brep(splints_w_direction_indicator)  # disabled
number_slider_2 = Slider(0.16, range=0.05..0.2)  # disabled
main_body_sharp_edges_2 = Curve(main_body_sharp_edges)  # disabled
left_slit_sharp_edges_2 = Curve(left_slit_sharp_edges)  # disabled
right_slit_sharp_edges_2 = Curve(right_slit_sharp_edges)  # disabled
number_slider_3 = Slider(1, range=0..10)  # disabled
tunable_mesh_conversion_py = Python3Script(breps_in=splint_form)  # -> out, meshes_out; inputs breps_in: list of Brep; disabled
# ---------- tunable_mesh_conversion_py: Python ----------
# This file represents a stub for a GhPython component in Grasshopper.
# It sets up the environment to import and use the splintcommon or other external modules.

from pathlib import Path
import sys
from importlib import reload #FOR DEV
import time

# Walk up through nested clusters to find the root GH document (necessary for use in nested clusters)
doc = ghenv.Component.OnPingDocument()
while not doc.FilePath and doc.Owner:
    doc = doc.Owner.OnPingDocument()
ghFileDir = str(Path(doc.FilePath).resolve().parent / "src")

print(f"{ghFileDir=}")

if ghFileDir not in sys.path:
    print("ghFileDir needed to be included")
    sys.path.append(ghFileDir)

import splintcommon
reload(splintcommon) #FOR DEV
from splintcommon import mark_generation_start
mark_generation_start()

#splintcommon module is now available for use in this GhPython component
splintcommon.log(f'GhPython Node initialized at {time.ctime()}')

#Component code here

import splintmeshes
reload(splintmeshes)
from splintmeshes import convert_to_export_meshes

meshes_out = convert_to_export_meshes(
    breps_in,
    quality="high",
    target_edge_length=0.2,
    # max_edge_length=0.3,
    min_edge_length=0.05,
    jagged_seams=False,
    simple_planes=True,
    refine_grid=False,
    weld_angle_degrees=180,        
    smoothing_iterations=0,        
    repair_if_needed=True,
    require_closed=True,
    require_manifold=True,
    shrinkwrap_fallback=True,
)

for i, mesh in enumerate(meshes_out):
    splintcommon.log(f"Mesh{i}:")
    splintcommon.log("mesh verts={}, faces={}, avg_edge={:.3f}mm".format(
        mesh.Vertices.Count,
        mesh.Faces.Count,
        mesh.TopologyEdges.Count and sum(mesh.TopologyEdges.EdgeLine(i).Length 
            for i in range(mesh.TopologyEdges.Count)) / mesh.TopologyEdges.Count
    ))


# Pre 5/21
# meshes_out = convert_to_export_meshes(
#     breps_in,
#     quality="high",
#     target_edge_length=0.7,
#     max_edge_length=0.7,
#     min_edge_length=0.03,
#     jagged_seams=False,
#     simple_planes=True,
#     refine_grid=False,
#     weld_angle_degrees=45,
#     smoothing_iterations=0,
#     repair_if_needed=True,
#     require_closed=True,
#     require_manifold=True,
#     shrinkwrap_fallback=True
# )

# 7.39 mb and good detail all around!
# meshes_out = convert_to_export_meshes(
#     breps_in,
#     quality="high",
#     target_edge_length=1.1,
#     max_edge_length=1.1,
#     min_edge_length=0.03,
#     jagged_seams=False,
#     simple_planes=True,
#     refine_grid=False,
#     weld_angle_degrees=45,
#     smoothing_iterations=0,
#     repair_if_needed=True,
#     require_closed=True,
#     require_manifold=True,
#     shrinkwrap_fallback=False
# )

# # 10mb, text good, bottoms rounded
# meshes_out = convert_to_export_meshes(
#     breps_in,
#     quality="high",
#     target_edge_length=0.9,
#     max_edge_length=0.9,
#     min_edge_length=0.02,
#     jagged_seams=False,
#     simple_planes=True,
#     refine_grid=False,
#     weld_angle_degrees=45,
#     smoothing_iterations=0,
#     repair_if_needed=True,
#     require_closed=True,
#     require_manifold=True,
#     shrinkwrap_fallback=False
# )

# 8Mb, good text, rounding on tops and bottoms
# meshes_out = convert_to_export_meshes(
#     breps_in,
#     quality="fast",
#     target_edge_length=1.5,
#     max_edge_length=2.0,
#     min_edge_length=0.10,
#     smoothing_iterations=0,
#     repair_if_needed=True,
#     require_closed=True,
#     require_manifold=True,
#     shrinkwrap_fallback=False
# )
# ---------- end tunable_mesh_conversion_py ----------
shrinkwrap = ShrinkWrap(
    Geometry=splint_form,
    EdgeLength=number_slider_2,
    Offset=0,
    Smoothing=number_slider_3,
    Optimization=panel_7,
    FillHoles=False)  # disabled
meshes = Geometry(tunable_mesh_conversion_py.meshes_out)  # disabled
output_mesh = Mesh(shrinkwrap)  # disabled
qa_py = Python3Script(output_breps=output_mesh)  # -> out, py_wall_probe_data; inputs output_breps: list of Brep; disabled
# ---------- qa_py: Python ----------
# This file represents a stub for a GhPython component in Grasshopper.
# It sets up the environment to import and use the splintcommon or other external modules.

from pathlib import Path
import sys
from importlib import reload #FOR DEV
import time

# Walk up through nested clusters to find the root GH document (necessary for use in nested clusters)
doc = ghenv.Component.OnPingDocument()
while not doc.FilePath and doc.Owner:
    doc = doc.Owner.OnPingDocument()
ghFileDir = str(Path(doc.FilePath).resolve().parent / "src")

print(f"{ghFileDir=}")

if ghFileDir not in sys.path:
    print("ghFileDir needed to be included")
    sys.path.append(ghFileDir)

import splintcommon
reload(splintcommon) #FOR DEV
from splintcommon import mark_generation_start, log
mark_generation_start()

#splintcommon module is now available for use in this GhPython component
splintcommon.log(f'GhPython Node initialized at {time.ctime()}')

#Component code here


import BrepInspect
reload(BrepInspect)
from BrepInspect import inspect_solid_breps

all_ok = inspect_solid_breps(output_breps, verbose=True)

py_wall_probe_data = [{"all_breps_ok": all_ok}]

if not all_ok:
    log("Breps failed structural inspection")
# ---------- end qa_py ----------
panel_46 = Panel(qa_py.out)  # disabled

merge_15 = Merge(Data1=main_body_sharp_edges_2, Data2=left_slit_sharp_edges_2, Data3=right_slit_sharp_edges_2)  # -> flatten(Result); disabled
triremesh = TriRemesh(Geometry=meshes, Sharp=boolean_toggle_4, Length=panel_9, Iterations=panel_10)  # -> Triangulation, Dual, Creases; disabled

mesh_edge_smoothing_py = Python3Script(input_mesh=triremesh.Triangulation, smooth_target_curves=merge_15)  # -> out, output_mesh; inputs input_mesh: Mesh, smooth_target_curves: list of Curve, protect_target_curves: list of Curve; disabled
# ---------- mesh_edge_smoothing_py: Python ----------
# This file represents a stub for a GhPython component in Grasshopper.
# It sets up the environment to import and use the splintcommon or other external modules.

from pathlib import Path
import sys
from importlib import reload #FOR DEV
import time

# Walk up through nested clusters to find the root GH document (necessary for use in nested clusters)
doc = ghenv.Component.OnPingDocument()
while not doc.FilePath and doc.Owner:
    doc = doc.Owner.OnPingDocument()
ghFileDir = str(Path(doc.FilePath).resolve().parent / "src")

print(f"{ghFileDir=}")

if ghFileDir not in sys.path:
    print("ghFileDir needed to be included")
    sys.path.append(ghFileDir)

import splintcommon
reload(splintcommon) #FOR DEV
from splintcommon import mark_generation_start
mark_generation_start()

#splintcommon module is now available for use in this GhPython component
splintcommon.log(f'Gh FilletSharpEdges Node initialized at {time.ctime()}')

#Component code here

import MeshSmooth
reload(MeshSmooth)
from MeshSmooth import smooth_mesh_near_curves

output_mesh = smooth_mesh_near_curves(
    input_mesh,
    smooth_curves=smooth_target_curves,
    protect_curves=protect_target_curves,
    band_mm=0.8, 
    falloff_mm=0.7,
    iterations=30, 
    lam=0.5, 
    mu=-0.45,
    clamp_displacement=True, 
    clamp_fraction=0.08,
)

# First attempts at the more advanced smooth, not bad, but some large over done trends
# output_mesh = smooth_mesh_near_curves(
#     input_mesh,
#     smooth_curves=smooth_target_curves,
#     protect_curves=protect_target_curves,
#     band_mm=0.8,
#     falloff_mm=0.7,
#     iterations=20,        # was 15: more cumulative carving
#     lam=0.7,              # was 0.5: bigger inward step
#     mu=-0.30,             # was -0.53: less un-shrink => net inward bias
# )

# from MeshSmooth import fillet_mesh_near_curves

# fillet_radius = 1.1   # was band_mm in the Taubin call
# falloff_mm    = 0.7

# output_mesh = fillet_mesh_near_curves(
#     input_mesh,
#     smooth_curves=smooth_target_curves,
#     protect_curves=protect_target_curves,   # optional
#     radius=fillet_radius,
#     falloff_mm=falloff_mm,
#     cleanup_iterations=3,
# )

splintcommon.log("verts={}, isClosed={}".format(output_mesh.Vertices.Count, output_mesh.IsClosed))
# ---------- end mesh_edge_smoothing_py ----------

mesh = Mesh(triremesh.Triangulation)  # disabled

# ----
# Print Bed Orientation
print_bed_laydown_line_5 = Line(print_bed_laydown_line_2)  # disabled
geometry_2 = Geometry(output_mesh)  # disabled
panel_47 = Panel("90")  # disabled
rotate_axis = RotateAxis(Geometry=geometry_2, Angle=degrees(panel_47), Axis=print_bed_laydown_line_5)  # -> Geometry, Transform; disabled
oriented_form = Geometry(rotate_axis.Geometry)  # disabled

# ----
# Wall Probe Data
middle_wall_probe_line_2 = Line(middle_wall_probe_line)  # disabled
right_probe_line_2 = Line(right_probe_line)  # disabled
left_probe_line_2 = Line(left_probe_line)  # disabled
splint_smooth_mesh = Mesh(output_mesh)  # disabled
wall_probe_data = Python3Script(
    splint_mesh=splint_smooth_mesh,
    left_probe_line=left_probe_line_2,
    right_probe_line=right_probe_line_2,
    middle_wall_probe_line=middle_wall_probe_line_2)  # -> out, preview_geos, py_wall_probe_data; inputs splint_mesh: Mesh, left_probe_line: Line, right_probe_line: Line, middle_wall_probe_line: Line; disabled
# ---------- wall_probe_data: Python ----------
# This file represents a stub for a GhPython component in Grasshopper.
# It sets up the environment to import and use the splintcommon or other external modules.

from pathlib import Path
import sys
from importlib import reload #FOR DEV
import time

# Walk up through nested clusters to find the root GH document (necessary for use in nested clusters)
doc = ghenv.Component.OnPingDocument()
while not doc.FilePath and doc.Owner:
    doc = doc.Owner.OnPingDocument()
ghFileDir = str(Path(doc.FilePath).resolve().parent / "src")

print(f"{ghFileDir=}")

if ghFileDir not in sys.path:
    print("ghFileDir needed to be included")
    sys.path.append(ghFileDir)

import splintcommon
reload(splintcommon) #FOR DEV
from splintcommon import mark_generation_start
mark_generation_start()

#splintcommon module is now available for use in this GhPython component
splintcommon.log(f'GhPython Node initialized at {time.ctime()}')

#Component code here

import splintmeasurement
reload(splintmeasurement) 
from splintmeasurement import measure_mesh_wall_thickness
preview_geos = []
py_wall_probe_data = {}

# LEFT upwards probe line
probe_data = measure_mesh_wall_thickness(splint_mesh, left_probe_line)
print(f"{probe_data=}")
py_wall_probe_data["left_ring_wall_thickness_mm"] = probe_data.get("thickness_mm", "None")
preview_geos.append(left_probe_line)
preview_geos.append(probe_data.get("inner_point", "None")) #"thickness_mm": None, "inner_point": inner_point, "outer_point": None
preview_geos.append(probe_data.get("outer_point", "None"))

# RIGHT upwards probe line
right_probe_data = measure_mesh_wall_thickness(splint_mesh, right_probe_line)
print(f"{right_probe_data=}")
py_wall_probe_data["right_ring_wall_thickness_mm"] = right_probe_data.get("thickness_mm", "None")
preview_geos.append(right_probe_line)
preview_geos.append(right_probe_data.get("inner_point", "None")) #"thickness_mm": None, "inner_point": inner_point, "outer_point": None
preview_geos.append(right_probe_data.get("outer_point", "None"))

# MIDDLE - left to right side probe line
middle_probe_data = measure_mesh_wall_thickness(splint_mesh, right_probe_line)
print(f"{middle_probe_data=}")
py_wall_probe_data["middle_wall_thickness_mm"] = middle_probe_data.get("thickness_mm", "None")
preview_geos.append(middle_wall_probe_line)
preview_geos.append(middle_probe_data.get("inner_point", "None")) #"thickness_mm": None, "inner_point": inner_point, "outer_point": None
preview_geos.append(middle_probe_data.get("outer_point", "None"))

# probe_thicknesses, preview_geo = measure_mesh_wall_thickness(splint_mesh, ray_lines, far_distance=200.0):
print(f"{py_wall_probe_data=}")

py_wall_probe_data = [py_wall_probe_data]
# ---------- end wall_probe_data ----------
panel_48 = Panel(wall_probe_data.py_wall_probe_data)  # disabled
probe_preview_geometry = Geometry(wall_probe_data.preview_geos)  # disabled
panel_49 = Panel(wall_probe_data.out)  # disabled
number_slider_4 = Slider(0, range=0..4)  # disabled
py_wall_probe_data = Data(wall_probe_data.py_wall_probe_data)  # disabled
list_item_5 = ListItem(List=probe_preview_geometry, Index=number_slider_4, Wrap=False)  # disabled

probe_preview_geometry_2 = Geometry(probe_preview_geometry)  # disabled
splint_smooth_mesh_2 = Mesh(output_mesh)  # disabled
oriented_splint = Geometry(oriented_form)  # disabled

# ----
# Report Results
dev_activate_toggle = BooleanToggle(False)  # disabled
axial_band_thickness_mm_8 = Number(axial_band_thickness_mm_4)  # disabled
py_wall_probe_data_2 = Data(py_wall_probe_data)  # disabled
root_filename_out_2 = Text(root_filename_out)  # disabled
output_dir_out_2 = Text(output_dir_out)  # disabled
splint_mesh = Mesh(oriented_form)  # disabled
panel_50 = Panel(py_wall_probe_data_2)  # disabled
savemeshpy = Python3Script(
    final_splint_mesh=splint_mesh,
    output_dir=output_dir_out_2,
    root_filename=root_filename_out_2,
    bool_activate=dev_activate_toggle,
    axial_band_thickness_mm=axial_band_thickness_mm_8,
    py_wall_probe_data=py_wall_probe_data_2)  # -> out; inputs final_splint_mesh: Mesh, axial_band_thickness_mm: Double; disabled
# ---------- savemeshpy: Python ----------
# This file represents a stub for a GhPython component in Grasshopper.
# It sets up the environment to import and use the splintcommon or other external modules.

from pathlib import Path
import sys
from importlib import reload #FOR DEV
import time

# Walk up through nested clusters to find the root GH document (necessary for use in nested clusters)
doc = ghenv.Component.OnPingDocument()
while not doc.FilePath and doc.Owner:
    doc = doc.Owner.OnPingDocument()
ghFileDir = str(Path(doc.FilePath).resolve().parent / "src")

print(f"{ghFileDir=}")

if ghFileDir not in sys.path:
    print("ghFileDir needed to be included")
    sys.path.append(ghFileDir)

import splintcommon
reload(splintcommon) #FOR DEV
from splintcommon import log, gh_decode

#splintcommon module is now available for use in this GhPython component
splintcommon.log(f'GhPython Node initialized at {time.ctime()}')

#Component code here

import splintmeshes
reload(splintmeshes)
from splintmeshes import save_job_output

wall_probe_data = gh_decode(py_wall_probe_data)

# With error handling
try:
    log(f"Logging to {output_dir=} {root_filename=}")
    #splintmeshes.save_mesh(final_splint_mesh, output_dir, root_filename, format_type="stl")

    save_job_output(final_splint_mesh, output_dir, root_filename, "3mf", custom_metadata={
        "wall_probe_data": wall_probe_data,
        "axial_band_thickness_mm": axial_band_thickness_mm,
    })
    log(f"Export succeeded: {output_dir=} {root_filename=}")
except splintmeshes.MeshExportError as e:
    log("Export failed: {}".format(e))
except ValueError as e:
    log("Bad input: {}".format(e))
# ---------- end savemeshpy ----------
panel_51 = Panel(savemeshpy)  # disabled

# ----
# Preview Steps
merge_16 = Merge(Data1=splint_brep_2, Data2=annotation_dot_4.AnnotationDot)  # -> flatten(Result); disabled
merge_17 = Merge(Data1=front_geometry, Data2=back_geometry, Data3=horizontal_geometry)  # -> flatten(Result); disabled
merge_18 = Merge(Data1=horizontal_cutter_3, Data2=blank_positioned_2)  # -> flatten(Result); disabled
merge_19 = Merge(Data1=circle, Data2=annotation_dot_2)  # -> flatten(Result); disabled
merge_20 = Merge(Data1=splint_with_embossed_id_2, Data2=projected_letters_brep_2, Data3=annotation_dot_6.AnnotationDot)  # -> flatten(Result); disabled
merge_21 = Merge(Data1=splints_w_direction_indicator_2, Data2=direction_sphere_2, Data3=annotation_dot_8.AnnotationDot)  # -> flatten(Result); disabled
merge_22 = Merge(Data1=splint_smooth_mesh_2, Data2=annotation_dot_7.AnnotationDot, Data3=probe_preview_geometry_2)  # -> flatten(Result); disabled
merge_23 = Merge(Data1=print_bed_laydown_line_3, Data2=oriented_splint, Data3=annotation_dot_9.AnnotationDot)  # -> flatten(Result); disabled
panel_52 = Panel("250, 0, 0")  # disabled
panel_53 = Panel("120, 0, 0")  # disabled
panel_54 = Panel("60, 0, 0")  # disabled
panel_55 = Panel("350, 0, 0")  # disabled
panel_56 = Panel("450, 0, 0")  # disabled
panel_57 = Panel("400, 0, 0")  # disabled
panel_58 = Panel("500, 0, 0")  # disabled
panel_59 = Panel("550, 0, 0")  # disabled
panel_60 = Panel("600, 0, 0")  # disabled
panel_61 = Panel("650, 0, 0")  # disabled
movecomplex_cl = MoveComplexCL(base_move_vector=panel_54, geo_data=merge_19, is_simple=True)  # disabled
movecomplex_cl_2 = MoveComplexCL(base_move_vector=panel_52, geo_data=merge_18, is_simple=True)  # disabled
movecomplex_cl_3 = MoveComplexCL(base_move_vector=panel_55, geo_data=merge_16, is_simple=True)  # disabled
movecomplex_cl_4 = MoveComplexCL(base_move_vector=panel_57, geo_data=merge_13, is_simple=True)  # disabled
movecomplex_cl_5 = MoveComplexCL(base_move_vector=panel_53, geo_data=merge_17, is_simple=True)  # disabled
movecomplex_cl_6 = MoveComplexCL(base_move_vector=panel_56, geo_data=merge_14, is_simple=True)  # disabled
movecomplex_cl_7 = MoveComplexCL(base_move_vector=panel_58, geo_data=merge_20, is_simple=True)  # disabled
movecomplex_cl_8 = MoveComplexCL(base_move_vector=panel_59, geo_data=merge_21, is_simple=True)  # disabled
movecomplex_cl_9 = MoveComplexCL(base_move_vector=panel_60, geo_data=merge_22, is_simple=True)  # disabled
movecomplex_cl_10 = MoveComplexCL(base_move_vector=panel_61, geo_data=merge_23, is_simple=True)  # disabled
merge_24 = Merge(
    Data1=movecomplex_cl,
    Data2=movecomplex_cl_5,
    Data3=movecomplex_cl_2,
    Data4=movecomplex_cl_3,
    Data5=movecomplex_cl_4,
    Data6=movecomplex_cl_6,
    Data7=movecomplex_cl_7,
    Data8=movecomplex_cl_8,
    Data9=movecomplex_cl_9,
    Data10=movecomplex_cl_10)  # -> flatten(Result); disabled
random_color = RandomColor(Data=merge_24, Seed=2, FastMode=False)  # disabled
custom_preview = CustomPreview(Geometry=merge_24, Material=random_color)  # disabled

# ==== cluster VizPlane
plane = ClusterInput()
deconstruct_plane = DeconstructPlane(Plane=plane)  # -> Origin, XAxis, YAxis, ZAxis
arrow = Arrow(start=deconstruct_plane.Origin, direction=deconstruct_plane.XAxis, arrowlen="3", text="X")  # -> cone_2, line, annotation_dot_2
arrow_2 = Arrow(start=deconstruct_plane.Origin, direction=deconstruct_plane.YAxis, arrowlen="3", text="Y")  # -> cone_2, line, annotation_dot_2
arrow_3 = Arrow(start=deconstruct_plane.Origin, direction=deconstruct_plane.ZAxis, arrowlen="3", text="Z")  # -> cone_2, line, annotation_dot_2
tip = Brep([arrow.cone_2, arrow_2.cone_2, arrow_3.cone_2])
line = Line([arrow.line, arrow_2.line, arrow_3.line])
annotation_dot = AnnotationDot([arrow.annotation_dot_2, arrow_2.annotation_dot_2, arrow_3.annotation_dot_2])
tip_2 = ClusterOutput(tip)
line_2 = ClusterOutput(line)
annotation_dot_2 = ClusterOutput(annotation_dot)

# ==== cluster MoveComplexCL
base_move_vector = ClusterInput()
is_simple = ClusterInput()
geo_data = ClusterInput()
is_simple_2 = Boolean(is_simple)
geo_data_2 = Geometry(geo_data)
base_move_vector_2 = Vector(base_move_vector)
pick_n_choose = PickNChoose(Pattern=is_simple_2, Stream0="40", Stream1="0")
transpose_py = Python3Script(data=geo_data_2)  # -> out, result; inputs data: tree of GeometryBase
# ---------- transpose_py: Python ----------
# Input: data (Tree Access)
# Output: result

from Grasshopper import DataTree
from Grasshopper.Kernel.Data import GH_Path

branches = [list(data.Branch(i)) for i in range(data.BranchCount)]

print("Branch count: {}".format(data.BranchCount))
for i, b in enumerate(branches):
    print("  Branch {}: {} items, path {}".format(i, len(b), data.Path(i)))

count = min(len(b) for b in branches)
print("Transposing: {} branches x {} items".format(len(branches), count))

result = DataTree[object]()
for i in range(count):
    path = GH_Path(i)
    for b in branches:
        result.Add(b[i], path)

print("Output: {} branches x {} items each".format(result.BranchCount, result.Branch(0).Count if result.BranchCount > 0 else 0))
# ---------- end transpose_py ----------
panel = Panel(transpose_py.out)
python_3_script = Python3Script(data=transpose_py.result, base_vector=base_move_vector_2, z_separation=pick_n_choose)  # -> out, vectors; inputs data: tree, base_vector: Vector3d, z_separation: Double
# ---------- python_3_script: Python ----------
# This file represents a stub for a GhPython component in Grasshopper.
# It sets up the environment to import and use the splintcommon or other external modules.

from pathlib import Path
import sys
from importlib import reload #FOR DEV
import time

# Walk up through nested clusters to find the root GH document (necessary for use in nested clusters)
doc = ghenv.Component.OnPingDocument()
while not doc.FilePath and doc.Owner:
    doc = doc.Owner.OnPingDocument()
ghFileDir = str(Path(doc.FilePath).resolve().parent / "src")

print(f"{ghFileDir=}")

if ghFileDir not in sys.path:
    print("ghFileDir needed to be included")
    sys.path.append(ghFileDir)

import splintcommon
reload(splintcommon) #FOR DEV

#splintcommon module is now available for use in this GhPython component
splintcommon.log(f'GhPython Node initialized at {time.ctime()}')

#Your code here

# Inputs:
#   data         (Tree Access, type hint: ghdoc Object)
#   base_vector  (Item Access, type hint: Vector3d)
#   z_separation (Item Access, type hint: float)
# Output:
#   vectors

import Rhino.Geometry as rg
from Grasshopper import DataTree
from Grasshopper.Kernel.Data import GH_Path

branch_count = data.BranchCount
print("Branches: {}, z_separation: {}".format(branch_count, z_separation))

vectors = DataTree[rg.Vector3d]()

for i in range(branch_count):
    path = data.Path(i)
    item_count = data.Branch(i).Count
    vec = rg.Vector3d(base_vector.X, base_vector.Y, base_vector.Z + z_separation * i)
    print("  Branch {} ({}): {} items, vec Z={:.2f}".format(i, path, item_count, vec.Z))
    # One vector per item so the tree matches the geometry tree for Move
    for j in range(item_count):
        vectors.Add(vec, path)
# ---------- end python_3_script ----------
move = Move(Geometry=transpose_py.result, Motion=python_3_script.vectors)  # -> Geometry, Transform
panel_2 = Panel(move.Geometry)
geometry = Geometry(move.Geometry)
geometry_2 = ClusterOutput(geometry)

# ==== cluster RingHoleAnalysis
right_curve = ClusterInput()
left_curve = ClusterInput()
extreme_left_back = Panel("-1000, 1000, 0")
extreme_left_front = Panel("1000, 1000, 0")
extreme_right_back = Panel("-1000, -1000, 0")
extreme_right_front = Panel("1000, -1000, 0")
right_curve_2 = Curve(right_curve)
left_curve_2 = Curve(left_curve)
extreme_right_front_pt = Point(extreme_right_front)
extreme_right_back_pt = Point(extreme_right_back)
extreme_left_front_pt = Point(extreme_left_front)
extreme_left_back_pt = Point(extreme_left_back)
center_front = CurveClosestPoint(Point=extreme_left_front_pt, Curve=right_curve_2)  # -> Point, Parameter, Distance
left_wall_front = CurveClosestPoint(Point=extreme_right_front_pt, Curve=left_curve_2)  # -> Point, Parameter, Distance
center_back = CurveClosestPoint(Point=extreme_left_back_pt, Curve=right_curve_2)  # -> Point, Parameter, Distance
left_wall_back = CurveClosestPoint(Point=extreme_right_back_pt, Curve=left_curve_2)  # -> Point, Parameter, Distance
merge = Merge(Data1=left_wall_front.Point, Data2=left_wall_back.Point, Data3=center_front.Point, Data4=center_back.Point)  # -> flatten(Result)
average = Average(Input=merge)
back_left_pt = Point(left_wall_back.Point)
front_left_pt = Point(left_wall_front.Point)
back_right_pt = Point(center_back.Point)
center_pt = Point(average)
front_right_pt = Point(center_front.Point)
center_pt_2 = ClusterOutput(center_pt)
back_left_pt_2 = ClusterOutput(back_left_pt)
front_left_pt_2 = ClusterOutput(front_left_pt)
back_right_pt_2 = ClusterOutput(back_right_pt)
front_right_pt_2 = ClusterOutput(front_right_pt)

# ==== cluster EdgeCurves
brep = ClusterInput()
deconstruct_brep = DeconstructBrep(Brep=brep)  # -> Faces, Edges, Vertices
sharp_edge_indexes = ClusterInput()
list_item = ListItem(List=deconstruct_brep.Edges, Sharp_edge_indexes=sharp_edge_indexes, Wrap=True)
sharp_edge_curves = Curve(list_item)
sharp_edge_curves_2 = ClusterOutput(sharp_edge_curves)

# ==== cluster Arrow
arrowlen = ClusterInput()
text = ClusterInput()
arrowlen_2 = Number(arrowlen)
text_2 = Text(text)
start = ClusterInput()
direction = ClusterInput()
division = Division(A=arrowlen_2, B="4")
line_sdl = LineSDL(Start=start, Direction=direction, Length=arrowlen_2)
end_points = EndPoints(Curve=line_sdl)  # -> Start, End
line = ClusterOutput(line_sdl)
plane_normal = PlaneNormal(Origin=end_points.End, ZAxis=line_sdl)
annotation_dot = AnnotationDot(Location=end_points.End, PrimaryText=text_2)  # -> AnnotationDot, Location, PrimaryText, TextHeight
cone = Cone(Base=plane_normal, Radius=division, Length=division)  # -> Cone, Tip
cone_2 = ClusterOutput(cone.Cone)
annotation_dot_2 = ClusterOutput(annotation_dot.AnnotationDot)
